vi "Main.gvi"   [LabVIEW NXG 5.0.0]
# This template is for the Queued Message Handler design pattern. The Event Handling Loop generates messages based on user interface actions. The Message Handling Loop processes messages generated by the Event Handling Loop, or by other messages. The messages are string values, so new messages can be added easily to the Message Cases case structure in the Message Handling Loop. Each message cluster can also provide an optional value for Message Data, which is a variant that can be converted to whatever message-specific data is required.
panel controls:
  "Exit": bool
  "TEMP Button": bool
  "LUX Button": bool
  "VISA Resource Name": "VISA Instr" = "COM5"
  "Initialize VISA": bool
  "CMD Button": bool
  "Initialize AI": bool
  "Panel Config Button": bool
  "Set PV Angle Button": bool
  "IR Thermometer Position": bool
  "Fans Button": bool
  "Brightness Config Button": bool
  "Optic Filter Config Button": bool
  "Reset CVM Button": bool
  "Stop": bool
  "Panel Config Selector": string
  "PV Angle": i32
  "Fans Selector": string
  "Optic Filter Selector": string
  "IR Thermometer Position Selector": string
  "Brightness": i32
  "Prepare CVM": bool
  "Command to Arduino": string = "@DO 34 0#"
  "Set LoadR": bool
  "No Load": bool
  "Set LoadRTotal": string
  "VAC Button": bool
  "Heat Selector": string
  "Heat Button": bool
  "Exit 2": bool
  "Do Something": bool
  "Do Something Else": bool
  "Tab": i32
  "LoadR1": string
  "LoadR10": string
  "LoadR100": string
  "LoadR1000": string
  "Measured Data": "Measured Data.gtype"
  "Receive MV": bool
panel indicators:
  "Display": string
  "Command reply": "ArduinoReply.gtype"
  "LUXSensor Reply": "ArduinoReply.gtype"
  "TempSensor Reply": "ArduinoReply.gtype"
  "AI measurements": waveform<f64>[]
  "Hardware Current Status": string
  "V Coeff": f64
  "C Coeff": f64
  "Recalculated Voltage": f64
  "Recalculated Current": f64
  "VAC Load Counter": i32
  "Voltage_Graph": f64[]
  "VISA Answer_2": "ArduinoReply.gtype"[]
  "Current_Graph": f64[]
  "PV-Connecting Solar Panels": string
  "MV-Panel Configuration": string
  "MV-Cooling": string
  "MV-Heating": string
  "MV-Optical Filter": string
  "MV-Panel Tilt Angle": string
  "MV-Light Power": string
  "MV-LoadR1": string
  "MV-LoadR2": string
  "MV-LoadR3": string
  "MV-LoadR4": string
  "API Key": string
  "Server URL": string
  "Status of Send to SystemLink Cycle": string
  "PV-Current, mA": f64
  "SendDoubleToCloud": string
  "PV-LoadR,Ohm": f64
  "PV-Voltage, V": f64
  "PV-Temperature, ºC": f64
  "PV-LightIntensity, W/m2": f64
  "PV-Panel Tilt Angle, º": f64
  "PV-Panel Cofiguration": string
  "SendStringToCloud": string
  "PV-Cooling": string
  "PV-Heating": string
  "PV-Optical Filter": string
  "PV-LoadR1": string
  "PV-LoadR2": string
  "PV-LoadR3": string
  "PV-LoadR4": string
  "Error out Systemlink Read Cycle": error
  "Voltage MidPoint": f64
  "Current MidPoint": f64
  "Arduino Status": string
  "SendArrayDoubleToCloud": string
  "TempSensor": f64
  "LuxSensor": f64
  "LuxSensor Error": string
  "Total Set LoadR": i32
  "TempSensor Error": string
  "MV-LoadRTotal": string
  "Voltage EndPoint": f64
  "Current EndPoint": f64
  "TempSensor IR": f64
  "PV-LoadRTotal": string
  "PV-Temperature IR Position": string
  "PV-LigthPower, %": f64
  "PV-Temperature IR, ºC": f64
  "Total LoadR_SET": string
types:
  "ArduinoReply.gtype" = cluster{"Timestamp": timestamp, "DATA": string}
  "Measured Data.gtype" = cluster{"Voltage, V": f64, "Current, mA": f64, "Luminous Flux, Lux": f64, "Temperature, GradC": f64, "Temperature IR, GradC": f64}
  T1 = cluster{"VISA Resource": "VISA Instr", "Physical Channel": "DAQmx Task"}
  "UI Data.gtype" = cluster{"Boolean": bool, "String": string, "Numeric": f64}
  "ValueRange.gtype" = cluster{"maximum value": f64, "minimum value": f64}
uses:
  NI::Skyline::Configuration::Open Configuration API Key.gvi
  NI::Skyline::TagHTTP::Query Tags.gvi
  NI::Skyline::TagHTTP::Open Tag.gvi
  NI::Skyline::TagHTTP::Read Tag (String).gvi
  NI::Skyline::TagHTTP::Close Tag (Single).gvi
  NI::Skyline::Configuration::Close Configuration.gvi
  Message Queue::Create All Message Queues.gvi
  Message Queue::Enqueue Message (Single).gvi
  Support::Error Handler - Event Handling Loop.gvi
  Message Queue::Dequeue Message.gvi
  NI::VISA::Configure Serial Port (Instr).gvi
  NI::VISA::Open (Instr).gvi
  NI::DAQmx::Internal::DAQmx Create Channel (AI-Voltage-Basic).gvi
  Queued Message Handler::VISA ReadWrite.gvi
  Queued Message Handler::VISA Reply Parse.gvi
  NI::DAQmx::Internal::DAQmx Read (Analog 2D DBL NChan NSamp).gvi
  NI::DAQmx::Internal::DAQmx Read (Analog 1D Wfm NChan NSamp).gvi
  Queued Message Handler::Panel Switch.gvi
  Queued Message Handler::VISA Multiple Write.gvi
  NI::G Core::Error::Display Error.gvi
  NI::DAQmx::Internal::DAQmx Stop Task.gvi
  NI::VISA::Close (Instr).gvi
  NI::G Core::Error::Build Error Cluster.gvi
  Support::Error Handler - Message Handling Loop.gvi
  NI::Skyline::TagHTTP::Write Tag (DBL).gvi
  NI::Skyline::TagHTTP::Write Tag (String).gvi
  NI::Vision::IMAQdx::Initialize.gvi
  NI::Vision::IMAQdx::Configure Grab.gvi
  NI::Vision::Core::Basics::Create Image.gvi
  NI::Vision::IMAQdx::Grab.gvi
  NI::Vision::IMAQdx::Close.gvi
diagram:
  $"MV-Panel Configuration" <- ""
  $"MV-Cooling" <- ""
  $"MV-Heating" <- ""
  $"MV-Optical Filter" <- ""
  $"MV-Panel Tilt Angle" <- ""
  $"MV-Light Power" <- ""
  $"MV-LoadR1" <- ""
  $"MV-LoadR2" <- ""
  $"MV-LoadR3" <- ""
  $"MV-LoadR4" <- ""
  $"MV-LoadRTotal" <- ""
  # PV Config
  # 	Single
  # 	Parallel 2
  # 	Parallel 2 Diode
  # 	Series 2
  # 	Series 2 Diode
  # 	Parallel 4
  # 	Parallel 4 Diode
  # 	Series 4
  # 	Series 4 Diode
  # 	Parallel Of Series
  # 	Parallel Of Series Diode
  # 	Series Of Parallel
  # 	Series Of Parallel Diode
  # Optic Filter Config
  # 	No Filter
  # 	Filter 1
  # 	Filter 2
  # IR Thermomether
  # 	None
  # 	Panel 1
  # 	Panel 2
  # 	Panel 3
  # 	Panel 4
  # Heating/Cooling
  # 	0
  # 	50
  # 	100
  # Light Power
  # 	0 ... 100
  # Panel Tilt Angle
  # 	0 ... 120
  # Load 1
  # 	1,2,3,5;
  # Load 2
  # 	10,20.40,50;
  # Load 3
  # 	100,200,400,500;
  # Load 4
  # 	1000,2000,4000;
  w1 = ["MV-Panels Configuration", "MV-Cooling", "MV-Heating", "MV-Optical Filter", "MV-Panel Tilt Angle", "MV-Light Power", "MV-LoadR1", "MV-LoadR2", "MV-LoadR3", "MV-LoadR4", "MV-LoadRTotal"]
  Array Size(array=w1) -> (size(s)=w2)
  Initialize Array(element=1904-12-31T23:00:00Z, size=w2) -> w3
  sequence {
    frame 0 {
      Wait(time to wait=20000)
    }
  }
  s1 = w3  # shift register
  while {
    Wait(time to wait=500)
    case ($"Receive MV") {
      frame False, Default {
        w4 = s1
      }
      frame True {
        call "Open Configuration API Key.gvi"(server url=$"Server URL", api key=$"API Key") -> (configuration=w5, error out=w6)
        call "Query Tags.gvi"(paths=w1, error in=w6, configuration=w5) -> (tags=w7, error out=w8)
        Build Array(reference to "MV-Panel Configuration", reference to "MV-Cooling", reference to "MV-Heating", reference to "MV-Optical Filter", reference to "MV-Panel Tilt Angle", reference to "MV-Light Power", reference to "MV-LoadR1", reference to "MV-LoadR2", reference to "MV-LoadR3", reference to "MV-LoadR4", reference to "MV-LoadRTotal") -> w9
        for {
          w10 = each element of w7
          w11 = each element of s1
          w12 = each element of w9
          Property Node(instance in=w10) -> ("Path"=w13, "Datatype"=w14)
          call "Open Tag.gvi"(path=w13, data type=w14, error in=w8, configuration=w5) -> (tag=w15, error out=w16)
          call "Read Tag (String).gvi"(tag in=w15, error in=w16) -> (value=w17, time stamp=w18, error out=w19)
          Is Greater(x=w18, y=w11) -> w20
          case (w20) {
            frame False, Default { }
            frame True {
              Property Node(instance in=w12, "ValueSignaling"=w17)
            }
          }
          append w18 to w4
        }
        for {
          w21 = each element of w7
          call "Close Tag (Single).gvi"(tag=w21, error in=w19) -> (error out=w22)
        }
        call "Close Configuration.gvi"(configuration=w5, error in=w22) -> (error out=w23)
        $"Error out Systemlink Read Cycle" <- w23
      }
    }
    next s1 = w4
    stop if $"Exit 2"
  }
  $"PV-Connecting Solar Panels" <- ""
  disable {
    frame Enabled { }
    frame Disabled {
      Destroy User Event()
    }
  }
  w24 = bool FALSE  # Stop Event
  Create User Event[EventName="Stop Event"](user event data type=w24) -> (error out=w25, user event out=w26)
  Register For Events("Stop Event"=w26) -> (event registration refnum out=w27)
  call "Create All Message Queues.gvi"(error in=w25) -> (message queues=w28, error out=w29)
  Property Node(instance in=w28) -> ("UI"=w30)
  s2 = w27  # shift register
  while {
    event (dynamic events = s2) {
      on "Exit" Value changed {
        call "Enqueue Message (Single).gvi"(priority message=TRUE, message queue in=w30, message="Exit") -> (message queue out=w33, error out=w32)
        w31 = default
      }
      on dynamic event 0 {
        $Display <- "\"Exit\" button pressed"
        w31 = TRUE
        w32 = default
        w33 = w30
      }
      on "Window" Close? {
        call "Enqueue Message (Single).gvi"(priority message=TRUE, message queue in=w30, message="Exit") -> (message queue out=w33)
        Event Filter("Discard?"=TRUE)
        w31 = default
        w32 = default
      }
      on "Initialize VISA" Value changed {
        call "Enqueue Message (Single).gvi"(message queue in=w30, message="Initialize VISA") -> (message queue out=w33, error out=w32)
        w31 = default
      }
      on "Initialize AI" Value changed {
        call "Enqueue Message (Single).gvi"(message queue in=w30, message="Initialize AI") -> (message queue out=w33, error out=w32)
        w31 = default
      }
      on "CMD Button" Value changed {
        call "Enqueue Message (Single).gvi"(message queue in=w30, message="Send CMD") -> (message queue out=w33, error out=w32)
        w31 = default
      }
      on "TEMP Button" Value changed {
        call "Enqueue Message (Single).gvi"(message queue in=w30, message="Get Temperature") -> (message queue out=w33, error out=w32)
        w31 = default
      }
      on "LUX Button" Value changed {
        call "Enqueue Message (Single).gvi"(message queue in=w30, message="Get Brightness") -> (message queue out=w33, error out=w32)
        w31 = default
      }
      on "Reset CVM Button" Value changed {
        call "Enqueue Message (Single).gvi"(message queue in=w30, message="Reset CVM") -> (message queue out=w33, error out=w32)
        w31 = default
      }
      on "Panel Config Button" Value changed {
        call "Enqueue Message (Single).gvi"(message queue in=w30, message="Reset CVM") -> (message queue out=w34, error out=w35)
        call "Enqueue Message (Single).gvi"(message queue in=w34, message="Panel Config", message data=$"Panel Config Selector", error in=w35) -> (message queue out=w33, error out=w32)
        w31 = default
      }
      on "MV-Panel Configuration" Value changed {
        Event Data() -> ("New Value"=w36)
        call "Enqueue Message (Single).gvi"(message queue in=w30, message="Reset CVM") -> (message queue out=w37, error out=w38)
        call "Enqueue Message (Single).gvi"(message queue in=w37, message="PV Config", message data=w36, error in=w38) -> (message queue out=w33, error out=w32)
        w31 = default
      }
      on "Heat Button" Value changed {
        call "Enqueue Message (Single).gvi"(message queue in=w30, message="Reset CVM") -> (message queue out=w39, error out=w40)
        call "Enqueue Message (Single).gvi"(message queue in=w39, message="Heat Config", message data=$"Heat Selector", error in=w40) -> (message queue out=w33, error out=w32)
        w31 = default
      }
      on "MV-Heating" Value changed {
        Event Data() -> ("New Value"=w41)
        call "Enqueue Message (Single).gvi"(message queue in=w30, message="Reset CVM") -> (message queue out=w42, error out=w43)
        call "Enqueue Message (Single).gvi"(message queue in=w42, message="Heat Config", message data=w41, error in=w43) -> (message queue out=w33, error out=w32)
        w31 = default
      }
      on "Set PV Angle Button" Value changed {
        call "Enqueue Message (Single).gvi"(message queue in=w30, message="Reset CVM") -> (message queue out=w44, error out=w45)
        call "Enqueue Message (Single).gvi"(message queue in=w44, message="Set PV Angle", message data=$"PV Angle", error in=w45) -> (message queue out=w33, error out=w32)
        w31 = default
      }
      on "MV-Panel Tilt Angle" Value changed {
        call "Enqueue Message (Single).gvi"(message queue in=w30, message="Reset CVM") -> (message queue out=w46, error out=w47)
        Event Data() -> ("New Value"=w48)
        Decimal String To Number(string=w48) -> (offset past number=w49)
        call "Enqueue Message (Single).gvi"(message queue in=w46, message="Set PV Angle", message data=w49, error in=w47) -> (message queue out=w33, error out=w32)
        w31 = default
      }
      on "IR Thermometer Position" Value changed {
        call "Enqueue Message (Single).gvi"(message queue in=w30, message="Reset CVM") -> (message queue out=w50, error out=w51)
        call "Enqueue Message (Single).gvi"(message queue in=w50, message="IR Thermometer Position", message data=$"IR Thermometer Position Selector", error in=w51) -> (message queue out=w33, error out=w32)
        w31 = default
      }
      on "Fans Button" Value changed {
        call "Enqueue Message (Single).gvi"(message queue in=w30, message="Reset CVM") -> (message queue out=w52, error out=w53)
        call "Enqueue Message (Single).gvi"(message queue in=w52, message="Fans Control", message data=$"Fans Selector", error in=w53) -> (message queue out=w33, error out=w32)
        w31 = default
      }
      on "MV-Cooling" Value changed {
        Event Data() -> ("New Value"=w54)
        call "Enqueue Message (Single).gvi"(message queue in=w30, message="Reset CVM") -> (message queue out=w55, error out=w56)
        call "Enqueue Message (Single).gvi"(message queue in=w55, message="Fans Control", message data=w54, error in=w56) -> (message queue out=w33, error out=w32)
        w31 = default
      }
      on "Brightness Config Button" Value changed {
        call "Enqueue Message (Single).gvi"(message queue in=w30, message="Reset CVM") -> (message queue out=w57, error out=w58)
        call "Enqueue Message (Single).gvi"(message queue in=w57, message="Brightness Config", message data=$Brightness, error in=w58) -> (message queue out=w33, error out=w32)
        w31 = default
      }
      on "MV-Light Power" Value changed {
        Event Data() -> ("New Value"=w59)
        call "Enqueue Message (Single).gvi"(message queue in=w30, message="Reset CVM") -> (message queue out=w60, error out=w61)
        call "Enqueue Message (Single).gvi"(message queue in=w60, message="Brightness Config", message data=w59, error in=w61) -> (message queue out=w33, error out=w32)
        w31 = default
      }
      on "Optic Filter Config Button" Value changed {
        call "Enqueue Message (Single).gvi"(message queue in=w30, message="Reset CVM") -> (message queue out=w62, error out=w63)
        call "Enqueue Message (Single).gvi"(message queue in=w62, message="Optic Filter Config", message data=$"Optic Filter Selector", error in=w63) -> (message queue out=w33, error out=w32)
        w31 = default
      }
      on "MV-Optical Filter" Value changed {
        Event Data() -> ("New Value"=w64)
        call "Enqueue Message (Single).gvi"(message queue in=w30, message="Reset CVM") -> (message queue out=w65, error out=w66)
        call "Enqueue Message (Single).gvi"(message queue in=w65, message="Optic Filter Config", message data=w64, error in=w66) -> (message queue out=w33, error out=w32)
        w31 = default
      }
      on "Prepare CVM" Value changed {
        call "Enqueue Message (Single).gvi"(message queue in=w30, message="Prepare CVM") -> (message queue out=w33, error out=w32)
        w31 = default
      }
      on "Set LoadR" Value changed; "Set LoadRTotal" Value changed {
        call "Enqueue Message (Single).gvi"(message queue in=w30, message="Reset CVM") -> (message queue out=w67, error out=w68)
        Is Empty String Or Path(string/path=$"Set LoadRTotal") -> w69
        Concatenate Strings($LoadR1, $LoadR10, $LoadR100, $LoadR1000) -> w70
        Select(s=w69, t=w70, f=$"Set LoadRTotal") -> w71
        call "Enqueue Message (Single).gvi"(message queue in=w67, message="Set LoadR", message data=w71, error in=w68) -> (message queue out=w33, error out=w32)
        w31 = default
      }
      on "MV-LoadRTotal" Value changed {
        Event Data() -> ("New Value"=w72)
        call "Enqueue Message (Single).gvi"(message queue in=w30, message="Reset CVM") -> (message queue out=w73, error out=w74)
        call "Enqueue Message (Single).gvi"(message queue in=w73, message="Set LoadR", message data=w72, error in=w74) -> (message queue out=w33, error out=w32)
        w31 = default
      }
      on "No Load" Value changed {
        call "Enqueue Message (Single).gvi"(message queue in=w30, message="Reset CVM") -> (message queue out=w75)
        call "Enqueue Message (Single).gvi"(message queue in=w75, message="NoLoad") -> (message queue out=w33, error out=w32)
        w31 = default
      }
      on "VAC Button" Value changed {
        call "Enqueue Message (Single).gvi"(message queue in=w30, message="VAC", message data=0) -> (message queue out=w33, error out=w32)
        $"VAC Load Counter" <- 0
        w31 = default
      }
    }
    call "Error Handler - Event Handling Loop.gvi"(message queue in=w33, error in=w32) -> (dup error in=w76)
    stop if w31
  }
  Unregister For Events(error in=w76, event registration refnum=s2)
  $"API Key" <- "zYUbuW0YNkg1G__lXfJiGVBNWME-HlVd2a5NUHp-IP"
  s3 = "UI Data.gtype" {all zero or empty}  # shift register
  s4 = T1 {"VISA Resource"="COM5", "Physical Channel"=""}  # shift register
  while {
    call "Dequeue Message.gvi"(message queue in=w30, error in=w29) -> (message queue out=w77, message=w78, message data=w79, error out=w80)
    $"Hardware Current Status" <- w78
    # s3: Data
    # s4: VISA
    # w26: Stop Event
    case (w78) ignore case {  # Message Cases
      frame "Initialize" {
        Flush Queue(error in=w80, queue=w77) -> (error out=w85, queue out=w86)
        call "Enqueue Message (Single).gvi"(message queue in=w86, message="Initialize VISA", error in=w85) -> (message queue out=w87, error out=w88)
        call "Enqueue Message (Single).gvi"(message queue in=w87, message="Set Arduino Status", error in=w88) -> (message queue out=w89, error out=w90)
        call "Enqueue Message (Single).gvi"(message queue in=w89, message="NoLoad", error in=w90) -> (message queue out=w91, error out=w92)
        call "Enqueue Message (Single).gvi"(message queue in=w91, message="Brightness Config", message data=2, error in=w92) -> (message queue out=w93, error out=w94)
        call "Enqueue Message (Single).gvi"(message queue in=w93, message="Fans Control", message data="0", error in=w94) -> (message queue out=w95, error out=w96)
        call "Enqueue Message (Single).gvi"(message queue in=w95, message="Heat Config", message data="0", error in=w96) -> (message queue out=w97, error out=w98)
        call "Enqueue Message (Single).gvi"(message queue in=w97, message="Optic Filter Config", message data="No Filter", error in=w98) -> (message queue out=w99, error out=w100)
        call "Enqueue Message (Single).gvi"(message queue in=w99, message="IR Thermometer Position", message data="None", error in=w100) -> (message queue out=w101, error out=w102)
        call "Enqueue Message (Single).gvi"(message queue in=w101, message="Set PV Angle", message data=90, error in=w102) -> (message queue out=w103, error out=w104)
        call "Enqueue Message (Single).gvi"(message queue in=w103, message="Panel Config", message data="Parallel 4", error in=w104) -> (message queue out=w105, error out=w106)
        call "Enqueue Message (Single).gvi"(message queue in=w105, message="Wait For Event", error in=w106) -> (error out=w81)
        Build Array(reference to "Arduino Status", reference to "TempSensor Error", reference to "LuxSensor Error") -> w107
        for {
          w108 = each element of w107
          Property Node(instance in=w108, "Value"="none")
        }
        Build Array(reference to "TempSensor", reference to "LuxSensor", reference to "Recalculated Voltage", reference to "Voltage EndPoint", reference to "Voltage MidPoint", reference to "Recalculated Current", reference to "Current EndPoint", reference to "Current MidPoint", reference to "V Coeff", reference to "C Coeff") -> w109
        for {
          w110 = each element of w109
          Property Node(instance in=w110, "Value"=-1)
        }
        Property Node(instance in=reference to "Set LoadRTotal", "Value"="")
        Property Node(instance in=reference to "VAC Load Counter", "Value"=0)
        w82 = s3
        w83 = default
        w84 = s4
      }
      frame "Initialize VISA" {
        call "Configure Serial Port (Instr).gvi"(stop bits="1.0"(10), session in=$"VISA Resource Name", error in=w80, baud rate=115200, parity="None"(0), termination char=0xA, enable termination char=TRUE) -> (session out=w111, error out=w112)
        call "Open (Instr).gvi"(resource name=w111, error in=w112) -> (session out=w113, error out=w81)
        Property Node(instance in=s4, "VISA Resource"=w113) -> (instance out=w84)
        Wait(time to wait=2000)
        w82 = s3
        w83 = default
      }
      frame "Initialize AI" {
        call "DAQmx Create Channel (AI-Voltage-Basic).gvi"(error in=w80, physical channels="Dev1/ai0:1,Dev1/ai3,Dev1/ai7,Dev1/ai6", units="Volts"(10348), measurement range="ValueRange.gtype" {"maximum value"=10, "minimum value"=0}, input terminal configuration="RSE"(10083)) -> (task out=w114, error out=w81)
        Property Node(instance in=s4, "Physical Channel"=w114) -> (instance out=w84)
        w82 = s3
        w83 = default
      }
      frame "Wait For Event" {
        Wait(time to wait=100)
        call "Enqueue Message (Single).gvi"(message queue in=w77, message="Watchdog", error in=w80) -> (error out=w81)
        w82 = s3
        w83 = default
        w84 = s4
      }
      frame "Send CMD" {
        Property Node(instance in=s4) -> ("VISA Resource"=w115, instance out=w84)
        call "Enqueue Message (Single).gvi"(message queue in=w77, message="Wait For Event", error in=w80) -> (error out=w116)
        call "VISA ReadWrite.gvi"(VISA_IN=w115, CMD=$"Command to Arduino", ERROR_IN=w116) -> (Arduino_Reply=w117, ERROR_OUT=w81)
        $"Command reply" <- w117
        w82 = s3
        w83 = default
      }
      frame "Set Arduino Status" {
        Property Node(instance in=s4) -> ("VISA Resource"=w118, instance out=w84)
        call "VISA ReadWrite.gvi"(VISA_IN=w118, CMD="@TIME 10 CEPHEI#", ERROR_IN=w80) -> (ERROR_OUT=w81)
        w82 = s3
        w83 = default
      }
      frame "Watchdog" {
        Property Node(instance in=s4) -> ("Physical Channel"=w119, "VISA Resource"=w120, instance out=w84)
        call "VISA ReadWrite.gvi"(VISA_IN=w120, CMD="@TIME 10 ?#", ERROR_IN=w80) -> (OUTPUT=w121, Arduino_Reply=w122, ERROR_OUT=w123)
        Property Node(instance in=w122) -> ("DATA"=w124)
        call "VISA Reply Parse.gvi"(string=w124) -> (Reply String=w125)
        Match Pattern(regular expression="CEPHEI", string=w125) -> (match substring=w126)
        Is Equal(x=w126, y="CEPHEI") -> w127
        case (w127) {
          frame False, Default {
            Flush Queue(error in=w123, queue=w77) -> (error out=w128, queue out=w129)
            call "Enqueue Message (Single).gvi"(message queue in=w129, message="Initialize", error in=w128) -> (error out=w81)
          }
          frame True {
            call "VISA ReadWrite.gvi"(VISA_IN=w121, CMD="@LUX 10 1#", ERROR_IN=w123) -> (OUTPUT=w130, Arduino_Reply=w131, ERROR_OUT=w132)
            call "VISA ReadWrite.gvi"(VISA_IN=w130, CMD="@TEMP 8 0#", ERROR_IN=w132) -> (Arduino_Reply=w133, ERROR_OUT=w134)
            call "DAQmx Read (Analog 2D DBL NChan NSamp).gvi"(task in=w119, error in=w134, number of samples per channel=1) -> (error out=w135, data=w136)
            Array Index(array=w136) -> (out0[4, 0]=w137)
            Multiply(w137, 20) -> w138
            $"TempSensor IR" <- w138
            Array Index(array=w136) -> (out0[1, 0]=w139, out1[2, 0]=w140)
            Multiply(w139, 4) -> w141
            Multiply(w141, $"V Coeff") -> w142
            Feedback Node(input=w143) -> w144
            Build Array(w144, w142) -> w143
            $Voltage_Graph <- w143
            $"Recalculated Voltage" <- w142
            $"Voltage EndPoint" <- w139
            $"Voltage MidPoint" <- w140
            Array Index(array=w136) -> (out0[0, 0]=w145, out1[3, 0]=w146)
            Divide(x=w145, y=70) -> w147
            Multiply(w147, 1000) -> w148
            Multiply(w148, $"C Coeff") -> w149
            Feedback Node(input=w150) -> w151
            Build Array(w151, w149) -> w150
            $Current_Graph <- w150
            $"Recalculated Current" <- w149
            $"Current EndPoint" <- w145
            $"Current MidPoint" <- w146
            call "DAQmx Read (Analog 1D Wfm NChan NSamp).gvi"(task in=w119, error in=w135, number of samples per channel=1) -> (error out=w152, data=w153)
            call "Enqueue Message (Single).gvi"(message queue in=w77, message="Wait For Event", error in=w152) -> (error out=w81)
            $"AI measurements" <- w153
            Property Node(instance in=reference to "PV-Current, mA", "Value"=w149)
            Property Node(instance in=w131) -> ("DATA"=w154, instance out=w155)
            $"LUXSensor Reply" <- w155
            Property Node(instance in=w133) -> ("DATA"=w156, instance out=w157)
            $"TempSensor Reply" <- w157
            Property Node(instance in=reference to "PV-Voltage, V", "Value"=w142)
            call "VISA Reply Parse.gvi"(string=w154) -> (Error code=w158, Reply=w159)
            Property Node(instance in=reference to "PV-LightIntensity, W/m2", "Value"=w159)
            call "VISA Reply Parse.gvi"(string=w156) -> (Error code=w160, Reply=w161)
            Property Node(instance in=$"Measured Data", "Voltage, V"=w142, "Current, mA"=w149, "Luminous Flux, Lux"=w159, "Temperature, GradC"=w161, "Temperature IR, GradC"=w138) -> (instance out=w162)
            $"Measured Data" <- w162
            $"LuxSensor Error" <- w158
            $"TempSensor Error" <- w160
            Property Node(instance in=reference to "PV-Temperature, ºC", "Value"=w161)
            $LuxSensor <- w159
            $TempSensor <- w161
          }
        }
        $"Arduino Status" <- w125
        w82 = s3
        w83 = default
      }
      frame "Panel Config" {
        call "Enqueue Message (Single).gvi"(message queue in=w77, message="Prepare CVM", error in=w80) -> (error out=w163)
        Variant To Data(error in (no error)=w163, type=string "", variant=w79) -> (data=w164, error out=w165)
        Property Node(instance in=s4) -> ("VISA Resource"=w166, instance out=w84)
        call "Panel Switch.gvi"(VISA_IN=w166, CTRL="Disconnect", ERROR_IN=w165) -> (VISA_OUT=w167, ERROR_OUT=w168)
        case (w164) {
          frame "Single" {
            w171 = ["@DO 17 0#", "@DO 18 1#", "@DO 23 1#", "@DO 24 1#", "@DO 25 1#", "@DO 26 0#", "@DO 27 0#", "@DO 28 0#", "@DO 29 1#", "@DO 30 1#", "@DO 31 1#", "@DO 32 1#", "@DO 33 0#"]
            w172 = ["@DO 54 1#", "@DO 55 1#", "@DO 56 1#", "@DO 57 1#", "@DO 58 1#", "@DO 59 1#", "@DO 60 1#", "@DO 61 1#"]
            # @DO 17 0#
            # @DO 18 1#
            # @DO 23 1#
            # @DO 24 1#
            # @DO 25 1#
            # @DO 26 0#
            # @DO 27 0#
            # @DO 28 0#
            # @DO 29 1#
            # @DO 30 1#
            # @DO 31 1#
            # @DO 32 1#
            # @DO 33 0#
            #
            # 03,08,2020
            # 19:51
            Insert Into Array(inArray=w171, new=w172) -> w173
            call "VISA Multiple Write.gvi"(VISA_IN=w167, ARRAY_IN=w173, ERROR_IN=w168) -> (ERROR_OUT=w169)
            w170 = w164
          }
          frame "Parallel 2" {
            # @DO 17 1#
            # @DO 18 0#
            # @DO 23 1#
            # @DO 24 0#
            # @DO 25 1#
            # @DO 26 1#
            # @DO 27 1#
            # @DO 28 1#
            # @DO 29 1#
            # @DO 30 1#
            # @DO 31 1#
            # @DO 32 1#
            # @DO 33 1#
            #
            # 03.08.2020
            # 19.53
            w174 = ["@DO 17 1#", "@DO 18 0#", "@DO 23 1#", "@DO 24 0#", "@DO 25 1#", "@DO 26 1#", "@DO 27 1#", "@DO 28 1#", "@DO 29 1#", "@DO 30 1#", "@DO 31 1#", "@DO 32 1#", "@DO 33 1#"]
            # Disconnect all Diodes
            w175 = ["@DO 54 1#", "@DO 55 1#", "@DO 56 1#", "@DO 57 1#", "@DO 58 1#", "@DO 59 1#", "@DO 60 1#", "@DO 61 1#"]
            Insert Into Array(inArray=w174, new=w175) -> w176
            call "VISA Multiple Write.gvi"(VISA_IN=w167, ARRAY_IN=w176, ERROR_IN=w168) -> (ERROR_OUT=w169)
            w170 = w164
          }
          frame "Parallel 2 Diode" {
            # @DO 17 1#
            # @DO 18 0#
            # @DO 23 1#
            # @DO 24 0#
            # @DO 25 1#
            # @DO 26 1#
            # @DO 27 1#
            # @DO 28 1#
            # @DO 29 1#
            # @DO 30 1#
            # @DO 31 1#
            # @DO 32 1#
            # @DO 33 1#
            #
            # 03.08.2020
            # 19.54
            w177 = ["@DO 17 1#", "@DO 18 0#", "@DO 23 1#", "@DO 24 0#", "@DO 25 1#", "@DO 26 1#", "@DO 27 1#", "@DO 28 1#", "@DO 29 1#", "@DO 30 1#", "@DO 31 1#", "@DO 32 1#", "@DO 33 1#"]
            # @DO 56 0#
            # @DO 57 0#
            #
            # 19.54
            w178 = ["@DO 54 1#", "@DO 55 1#", "@DO 56 0#", "@DO 57 0#", "@DO 58 1#", "@DO 59 1#", "@DO 60 1#", "@DO 61 1#"]
            Insert Into Array(inArray=w177, new=w178) -> w179
            call "VISA Multiple Write.gvi"(VISA_IN=w167, ARRAY_IN=w179, ERROR_IN=w168) -> (ERROR_OUT=w169)
            w170 = w164
          }
          frame "Series 2" {
            # @DO 17 0#
            # @DO 18 1#
            # @DO 23 1#
            # @DO 24 0#
            # @DO 25 1#
            # @DO 26 1#
            # @DO 27 1#
            # @DO 28 1#
            # @DO 29 0#
            # @DO 30 1#
            # @DO 31 1#
            # @DO 32 0#
            # @DO 33 0#
            #
            # 03.08.2020
            # 19.55
            w180 = ["@DO 17 0#", "@DO 18 1#", "@DO 23 1#", "@DO 24 0#", "@DO 25 1#", "@DO 26 1#", "@DO 27 1#", "@DO 28 1#", "@DO 29 0#", "@DO 30 1#", "@DO 31 1#", "@DO 32 0#", "@DO 33 0#"]
            w181 = ["@DO 54 1#", "@DO 55 1#", "@DO 56 1#", "@DO 57 1#", "@DO 58 1#", "@DO 59 1#", "@DO 60 1#", "@DO 61 1#"]
            Insert Into Array(inArray=w180, new=w181) -> w182
            call "VISA Multiple Write.gvi"(VISA_IN=w167, ARRAY_IN=w182, ERROR_IN=w168) -> (ERROR_OUT=w169)
            w170 = w164
          }
          frame "Series 2 Diode" {
            # @DO 17 0#
            # @DO 18 1#
            # @DO 23 1#
            # @DO 24 0#
            # @DO 25 1#
            # @DO 26 1#
            # @DO 27 1#
            # @DO 28 1#
            # @DO 29 0#
            # @DO 30 1#
            # @DO 31 1#
            # @DO 32 0#
            # @DO 33 0#
            #
            # 03.08.2020
            # 19.57
            w183 = ["@DO 17 0#", "@DO 18 1#", "@DO 23 1#", "@DO 24 0#", "@DO 25 1#", "@DO 26 1#", "@DO 27 1#", "@DO 28 1#", "@DO 29 0#", "@DO 30 1#", "@DO 31 1#", "@DO 32 0#", "@DO 33 0#"]
            # @DO 60 0#
            # @DO 61 0#
            #
            # 03.08.2020
            w184 = ["@DO 54 1#", "@DO 55 1#", "@DO 56 1#", "@DO 57 1#", "@DO 58 1#", "@DO 59 1#", "@DO 60 0#", "@DO 61 0#"]
            Insert Into Array(inArray=w183, new=w184) -> w185
            call "VISA Multiple Write.gvi"(VISA_IN=w167, ARRAY_IN=w185, ERROR_IN=w168) -> (ERROR_OUT=w169)
            w170 = w164
          }
          frame "Parallel 4", Default {
            # @DO 17 1#
            # @DO 18 1#
            # @DO 23 1#
            # @DO 24 1#
            # @DO 25 1#
            # @DO 26 1#
            # @DO 27 1#
            # @DO 28 1#
            # @DO 29 1#
            # @DO 30 1#
            # @DO 31 1#
            # @DO 32 1#
            # @DO 33 1#
            #
            # 03.08.2020
            # 19.59
            w186 = ["@DO 17 1#", "@DO 18 1#", "@DO 23 1#", "@DO 24 1#", "@DO 25 1#", "@DO 26 1#", "@DO 27 1#", "@DO 28 1#", "@DO 29 1#", "@DO 30 1#", "@DO 31 1#", "@DO 32 1#", "@DO 33 1#"]
            w187 = ["@DO 54 1#", "@DO 55 1#", "@DO 56 1#", "@DO 57 1#", "@DO 58 1#", "@DO 59 1#", "@DO 60 1#", "@DO 61 1#"]
            Insert Into Array(inArray=w186, new=w187) -> w188
            call "VISA Multiple Write.gvi"(VISA_IN=w167, ARRAY_IN=w188, ERROR_IN=w168) -> (ERROR_OUT=w169)
            w170 = "Parallel 4"
          }
          frame "Parallel 4 Diode" {
            # @DO 17 1#
            # @DO 18 1#
            # @DO 23 1#
            # @DO 24 1#
            # @DO 25 1#
            # @DO 26 1#
            # @DO 27 1#
            # @DO 28 1#
            # @DO 29 1#
            # @DO 30 1#
            # @DO 31 1#
            # @DO 32 1#
            # @DO 33 1#
            # 03.08.2020
            # 20.00
            w189 = ["@DO 17 1#", "@DO 18 1#", "@DO 23 1#", "@DO 24 1#", "@DO 25 1#", "@DO 26 1#", "@DO 27 1#", "@DO 28 1#", "@DO 29 1#", "@DO 30 1#", "@DO 31 1#", "@DO 32 1#", "@DO 33 1#"]
            # @DO 54 0#
            # @DO 55 0#
            # @DO 56 0#
            # @DO 57 0#
            #
            # 03.08.2020
            # 20.00
            w190 = ["@DO 54 0#", "@DO 55 0#", "@DO 56 0#", "@DO 57 0#", "@DO 58 1#", "@DO 59 1#", "@DO 60 1#", "@DO 61 1#"]
            Insert Into Array(inArray=w189, new=w190) -> w191
            call "VISA Multiple Write.gvi"(VISA_IN=w167, ARRAY_IN=w191, ERROR_IN=w168) -> (ERROR_OUT=w169)
            w170 = w164
          }
          frame "Series 4" {
            # @DO 17 0#
            # @DO 18 1#
            # @DO 23 0#
            # @DO 24 1#
            # @DO 25 1#
            # @DO 26 0#
            # @DO 27 0#
            # @DO 28 0#
            # @DO 29 0#
            # @DO 30 0#
            # @DO 31 0#
            # @DO 32 0#
            # @DO 33 0#
            #
            # 03.08.2020
            # 20.02
            w192 = ["@DO 17 0#", "@DO 18 1#", "@DO 23 0#", "@DO 24 1#", "@DO 25 1#", "@DO 26 0#", "@DO 27 0#", "@DO 28 0#", "@DO 29 0#", "@DO 30 0#", "@DO 31 0#", "@DO 32 0#", "@DO 33 0#"]
            w193 = ["@DO 54 1#", "@DO 55 1#", "@DO 56 1#", "@DO 57 1#", "@DO 58 1#", "@DO 59 1#", "@DO 60 1#", "@DO 61 1#"]
            Insert Into Array(inArray=w192, new=w193) -> w194
            call "VISA Multiple Write.gvi"(VISA_IN=w167, ARRAY_IN=w194, ERROR_IN=w168) -> (ERROR_OUT=w169)
            w170 = w164
          }
          frame "Series 4 Diode" {
            # @DO 17 0#
            # @DO 18 1#
            # @DO 23 0#
            # @DO 24 1#
            # @DO 25 1#
            # @DO 26 0#
            # @DO 27 0#
            # @DO 28 0#
            # @DO 29 0#
            # @DO 30 0#
            # @DO 31 0#
            # @DO 32 0#
            # @DO 33 0#
            #
            # 03.08.2020
            # 20.03
            w195 = ["@DO 17 0#", "@DO 18 1#", "@DO 23 0#", "@DO 24 1#", "@DO 25 1#", "@DO 26 0#", "@DO 27 0#", "@DO 28 0#", "@DO 29 0#", "@DO 30 0#", "@DO 31 0#", "@DO 32 0#", "@DO 33 0#"]
            # @DO 58 0#
            # @DO 59 0#
            # @DO 60 0#
            # @DO 61 0#
            #
            # 03.08.2020
            # 20.04
            w196 = ["@DO 54 1#", "@DO 55 1#", "@DO 56 1#", "@DO 57 1#", "@DO 58 0#", "@DO 59 0#", "@DO 60 0#", "@DO 61 0#"]
            Insert Into Array(inArray=w195, new=w196) -> w197
            call "VISA Multiple Write.gvi"(VISA_IN=w167, ARRAY_IN=w197, ERROR_IN=w168) -> (ERROR_OUT=w169)
            w170 = w164
          }
          frame "Parallel Of Series" {
            # @DO 17 1#
            # @DO 18 1#
            # @DO 23 1#
            # @DO 24 1#
            # @DO 25 1#
            # @DO 26 1#
            # @DO 27 0#
            # @DO 28 1#
            # @DO 29 0#
            # @DO 30 0#
            # @DO 31 1#
            # @DO 32 0#
            # @DO 33 1#
            #
            # 03.08.2020
            # 20.05
            w198 = ["@DO 17 1#", "@DO 18 1#", "@DO 23 1#", "@DO 24 1#", "@DO 25 1#", "@DO 26 1#", "@DO 27 0#", "@DO 28 1#", "@DO 29 0#", "@DO 30 0#", "@DO 31 1#", "@DO 32 0#", "@DO 33 1#"]
            w199 = ["@DO 54 1#", "@DO 55 1#", "@DO 56 1#", "@DO 57 1#", "@DO 58 1#", "@DO 59 1#", "@DO 60 1#", "@DO 61 1#"]
            Insert Into Array(inArray=w198, new=w199) -> w200
            call "VISA Multiple Write.gvi"(VISA_IN=w167, ARRAY_IN=w200, ERROR_IN=w168) -> (ERROR_OUT=w169)
            w170 = w164
          }
          frame "Parallel Of Series Diode" {
            # @DO 17 1#
            # @DO 18 1#
            # @DO 23 1#
            # @DO 24 1#
            # @DO 25 1#
            # @DO 26 1#
            # @DO 27 0#
            # @DO 28 1#
            # @DO 29 0#
            # @DO 30 0#
            # @DO 31 1#
            # @DO 32 0#
            # @DO 33 1#
            #
            # 03.08.2020
            # 20.06
            # @DO 58 0#
            # @DO 59 0#
            # @DO 60 0#
            # @DO 61 0#
            #
            # 03.08.2020
            # 20.097
            w201 = ["@DO 17 1#", "@DO 18 1#", "@DO 23 1#", "@DO 24 1#", "@DO 25 1#", "@DO 26 1#", "@DO 27 0#", "@DO 28 1#", "@DO 29 0#", "@DO 30 0#", "@DO 31 1#", "@DO 32 0#", "@DO 33 1#"]
            w202 = ["@DO 54 1#", "@DO 55 1#", "@DO 56 1#", "@DO 57 1#", "@DO 58 0#", "@DO 59 0#", "@DO 60 0#", "@DO 61 0#"]
            Insert Into Array(inArray=w201, new=w202) -> w203
            call "VISA Multiple Write.gvi"(VISA_IN=w167, ARRAY_IN=w203, ERROR_IN=w168) -> (ERROR_OUT=w169)
            w170 = w164
          }
          frame "Series Of Parallel" {
            w204 = ["@DO 54 1#", "@DO 55 1#", "@DO 56 1#", "@DO 57 1#", "@DO 58 1#", "@DO 59 1#", "@DO 60 1#", "@DO 61 1#"]
            # @DO 17 1#
            # @DO 18 0#
            # @DO 23 0#
            # @DO 24 0#
            # @DO 25 0#
            # @DO 26 1#
            # @DO 27 1#
            # @DO 28 1#
            # @DO 29 1#
            # @DO 30 1#
            # @DO 31 1#
            # @DO 32 1#
            # @DO 33 1#
            #
            # 03.08.2020
            # 20.07
            w205 = ["@DO 17 1#", "@DO 18 0#", "@DO 23 0#", "@DO 24 0#", "@DO 25 0#", "@DO 26 1#", "@DO 27 1#", "@DO 28 1#", "@DO 29 1#", "@DO 30 1#", "@DO 31 1#", "@DO 32 1#", "@DO 33 1#"]
            Insert Into Array(inArray=w205, new=w204) -> w206
            call "VISA Multiple Write.gvi"(VISA_IN=w167, ARRAY_IN=w206, ERROR_IN=w168) -> (ERROR_OUT=w169)
            w170 = w164
          }
          frame "Series Of Parallel Diode" {
            # @DO 17 1#
            # @DO 18 0#
            # @DO 23 0#
            # @DO 24 0#
            # @DO 25 0#
            # @DO 26 1#
            # @DO 27 1#
            # @DO 28 1#
            # @DO 29 1#
            # @DO 30 1#
            # @DO 31 1#
            # @DO 32 1#
            # @DO 33 1#
            #
            # 03.08.2020
            # 20.08
            w207 = ["@DO 17 1#", "@DO 18 0#", "@DO 23 0#", "@DO 24 0#", "@DO 25 0#", "@DO 26 1#", "@DO 27 1#", "@DO 28 1#", "@DO 29 1#", "@DO 30 1#", "@DO 31 1#", "@DO 32 1#", "@DO 33 1#"]
            # @DO 54 0#
            # @DO 55 0#
            # @DO 56 0#
            # @DO 57 0#
            #
            # 20.09
            # 03.08.2020
            w208 = ["@DO 54 0#", "@DO 55 0#", "@DO 56 0#", "@DO 57 0#", "@DO 58 1#", "@DO 59 1#", "@DO 60 1#", "@DO 61 1#"]
            Insert Into Array(inArray=w207, new=w208) -> w209
            call "VISA Multiple Write.gvi"(VISA_IN=w167, ARRAY_IN=w209, ERROR_IN=w168) -> (ERROR_OUT=w169)
            w170 = w164
          }
        }
        Property Node(instance in=reference to "PV-Panel Cofiguration", "ValueSignaling"=w170)
        call "Panel Switch.gvi"(VISA_IN=w166, CTRL="Connect", ERROR_IN=w169) -> (ERROR_OUT=w81)
        w82 = s3
        w83 = default
      }
      frame "Prepare CVM" {
        Property Node(instance in=s4) -> ("VISA Resource"=w210, "Physical Channel"=w211, instance out=w84)
        call "DAQmx Read (Analog 2D DBL NChan NSamp).gvi"(task in=w211, error in=w80, number of samples per channel=1) -> (error out=w212, data=w213)
        Array Index(array=w213) -> (out0[2, 0]=w214)
        Multiply(w214, 4) -> w215
        C Code Node("x"=w215, Error In=w212) -> ("y"=w216, Error Out=w217)
        ~~~
        if(x>-1 && x<=1)
          y = 0;
        if(x>1 && x<=10)
          y = 3;
        if(x>10 && x<=20)
          y = 2;
        if(x>20 && x<=30)
          y = 1;
        ~~~
        Array Index(array=w213) -> (out0[3, 0]=w218)
        # Tip For Local Wiring Solution
        # Relay 1(50) 	DO 1- REP A x1
        # 		DO 0- AMP A x10
        #
        # Relay 2(51) 	DO 1-REP V x1
        # 		DO 0-DIV V x0.25
        # Relay 3(52) 	DO 1-REP V x1
        # 		DO 0-DIV V x0.5
        # Relay 4(53) 	DO 1-REP V x1
        # 		DO 0-AMP V x10
        C Code Node("x"=w218, Error In=w217) -> ("y"=w219, Error Out=w220)
        ~~~
        if(x>-1 && x<=0.6)
          y = 0;
        if(x>0.6 && x<=6)
          y = 1;
        ~~~
        # Voltage Range
        case (w216) {
          frame 0, Default {
            call "VISA Multiple Write.gvi"(VISA_IN=w210, ARRAY_IN=["@DO 51 1#", "@DO 52 1#", "@DO 53 0#"], ERROR_IN=w220) -> (VISA Answer=w223, ERROR_OUT=w221)
            w222 = 0.1
          }
          frame 1 {
            call "VISA Multiple Write.gvi"(VISA_IN=w210, ARRAY_IN=["@DO 51 1#", "@DO 52 1#", "@DO 53 1#"], ERROR_IN=w220) -> (VISA Answer=w223, ERROR_OUT=w221)
            w222 = 1
          }
          frame 2 {
            call "VISA Multiple Write.gvi"(VISA_IN=w210, ARRAY_IN=["@DO 51 1#", "@DO 52 0#", "@DO 53 1#"], ERROR_IN=w220) -> (VISA Answer=w223, ERROR_OUT=w221)
            w222 = 0.5
          }
          frame 3 {
            # Div x0.25 works with 2 relay
            call "VISA Multiple Write.gvi"(VISA_IN=w210, ARRAY_IN=["@DO 51 0#", "@DO 52 0#", "@DO 53 1#"], ERROR_IN=w220) -> (VISA Answer=w223, ERROR_OUT=w221)
            w222 = 0.25
          }
        }
        $"V Coeff" <- w222
        $"VISA Answer_2" <- w223
        # Current Range
        case (w219) {
          frame 0, Default {
            call "VISA Multiple Write.gvi"(VISA_IN=w210, ARRAY_IN=["@DO 50 0#"], ERROR_IN=w221) -> (ERROR_OUT=w81)
            w224 = 0.1
          }
          frame 1 {
            call "VISA Multiple Write.gvi"(VISA_IN=w210, ARRAY_IN=["@DO 50 1#"], ERROR_IN=w221) -> (ERROR_OUT=w81)
            w224 = 1
          }
        }
        $"C Coeff" <- w224
        w82 = s3
        w83 = default
      }
      frame "Reset CVM" {
        $"V Coeff" <- 1
        $"C Coeff" <- 1
        Property Node(instance in=s4) -> ("VISA Resource"=w225, instance out=w84)
        # VOLTAGE RANGE
        # @DO 51 0#
        # @DO 52 0#
        # @DO 53 0#
        call "VISA Multiple Write.gvi"(VISA_IN=w225, ARRAY_IN=["@DO 51 1#", "@DO 52 1#", "@DO 53 1#"], ERROR_IN=w80) -> (VISA_OUT=w226, ERROR_OUT=w227)
        # CURRENT RANGE
        # @DO 50 1#
        call "VISA Multiple Write.gvi"(VISA_IN=w226, ARRAY_IN=["@DO 50 1#"], ERROR_IN=w227) -> (ERROR_OUT=w81)
        w82 = s3
        w83 = default
      }
      frame "VAC" {
        Property Node(instance in=s4) -> (instance out=w84)
        w228 = ["0", "1,", "10,", "20,10,", "50,", "50,20,", "100,", "100,40,10,", "200,100,", "500,100,", "1000,", "2000,", "2000,1000,", "4000,", "4000,1000,", "4000,2000,", "4000,2000,1000,", "4000,2000,1000,500,400,100,"]
        Variant To Data(type=i32 5, variant=w79) -> (data=w229)
        Array Size(array=w228) -> (size(s)=w230)
        Is Less Or Equal(x=$"VAC Load Counter", y=w230) -> w231
        Is Greater Or Equal(x=w229, y=i32 5) -> w232
        Logical And(w232, w231) -> w233
        case (w233) {
          frame False, Default {
            case (w231) {
              frame False, Default {
                Flush Queue(error in=w80, queue=w77) -> (error out=w235, queue out=w236)
                call "Enqueue Message (Single).gvi"(message queue in=w236, message="NoLoad", error in=w235) -> (message queue out=w237, error out=w238)
                call "Enqueue Message (Single).gvi"(message queue in=w237, message="Watchdog", error in=w238) -> (error out=w81)
                w234 = 0
              }
              frame True {
                Flush Queue(error in=w80, queue=w77) -> (error out=w239, queue out=w240)
                call "Enqueue Message (Single).gvi"(message queue in=w240, message="Watchdog", error in=w239) -> (message queue out=w241, error out=w242)
                Increment(x=w229) -> w243
                call "Enqueue Message (Single).gvi"(message queue in=w241, message="VAC", message data=w243, error in=w242) -> (error out=w81)
                w234 = $"VAC Load Counter"
              }
            }
          }
          frame True {
            Array Index(array=w228) -> (out0[$"VAC Load Counter"]=w244)
            Flush Queue(error in=w80, queue=w77) -> (error out=w245, queue out=w246)
            call "Enqueue Message (Single).gvi"(message queue in=w246, message="Set LoadR", message data=w244, error in=w245) -> (message queue out=w247, error out=w248)
            call "Enqueue Message (Single).gvi"(message queue in=w247, message="VAC", message data=0, error in=w248) -> (error out=w81)
            Increment(x=$"VAC Load Counter") -> w234
          }
        }
        $"VAC Load Counter" <- w234
        w82 = s3
        w83 = default
      }
      frame "Optic Filter Config" {
        call "Enqueue Message (Single).gvi"(message queue in=w77, message="Prepare CVM", error in=w80) -> (error out=w249)
        Variant To Data(error in (no error)=w249, type=string "", variant=w79) -> (data=w250, error out=w251)
        case (w250) {
          frame "No Filter", Default {
            w252 = ["@SERV 3 90#", "@SERV 4 0#"]
            w253 = "No Filter"
          }
          frame "Filter 1" {
            w252 = ["@SERV 3 90#", "@SERV 4 0#", "@SERV 3 0#"]
            w253 = w250
          }
          frame "Filter 2" {
            w252 = ["@SERV 3 90#", "@SERV 4 0#", "@SERV 4 90#"]
            w253 = w250
          }
        }
        Property Node(instance in=reference to "PV-Optical Filter", "ValueSignaling"=w253)
        Property Node(instance in=s4) -> ("VISA Resource"=w254, instance out=w84)
        call "VISA Multiple Write.gvi"(VISA_IN=w254, ARRAY_IN=w252, ERROR_IN=w251) -> (ERROR_OUT=w81)
        w82 = s3
        w83 = default
      }
      frame "Fans Control" {
        call "Enqueue Message (Single).gvi"(message queue in=w77, message="Prepare CVM", error in=w80) -> (error out=w255)
        Variant To Data(error in (no error)=w255, type=string "", variant=w79) -> (data=w256, error out=w257)
        case (w256) {
          frame "0", Default {
            w258 = ["@DO 11 0#", "@DO 12 0#"]
            w259 = "0"
          }
          frame "100" {
            w258 = ["@PWM 11 255#", "@PWM 12 255#"]
            w259 = "100"
          }
          frame "50" {
            w258 = ["@PWM 11 127#", "@PWM 12 127#"]
            w259 = "50"
          }
        }
        Property Node(instance in=reference to "PV-Cooling", "ValueSignaling"=w259)
        Property Node(instance in=s4) -> ("VISA Resource"=w260, instance out=w84)
        call "VISA Multiple Write.gvi"(VISA_IN=w260, ARRAY_IN=w258, ERROR_IN=w257) -> (ERROR_OUT=w81)
        w82 = s3
        w83 = default
      }
      frame "Heat Config" {
        call "Enqueue Message (Single).gvi"(message queue in=w77, message="Prepare CVM", error in=w80) -> (error out=w261)
        Variant To Data(error in (no error)=w261, type=string "", variant=w79) -> (data=w262, error out=w263)
        case (w262) {
          frame "0", Default {
            w264 = ["@DO 9 0#"]
            w265 = "0"
          }
          frame "50" {
            w264 = ["@PWM 9 125#"]
            w265 = "50"
          }
          frame "100" {
            w264 = ["@PWM 9 255#"]
            w265 = "100"
          }
        }
        Property Node(instance in=reference to "PV-Heating", "ValueSignaling"=w265)
        Property Node(instance in=s4) -> ("VISA Resource"=w266, instance out=w84)
        call "VISA Multiple Write.gvi"(VISA_IN=w266, ARRAY_IN=w264, ERROR_IN=w263) -> (ERROR_OUT=w81)
        w82 = s3
        w83 = default
      }
      frame "Set PV Angle" {
        call "Enqueue Message (Single).gvi"(message queue in=w77, message="Prepare CVM", error in=w80) -> (error out=w267)
        Variant To Data(error in (no error)=w267, type=u32 0, variant=w79) -> (data=w268, error out=w269)
        # Set angle limits for PV panels
        In Range And Coerce(lower limit=0, upper limit=180, x=w268) -> (coerced(x)=w270)
        Property Node(instance in=reference to "PV-Panel Tilt Angle, º", "ValueSignaling"=w270)
        Property Node(instance in=s4) -> ("VISA Resource"=w271, instance out=w84)
        Number To Decimal String(number=w270) -> (decimal integer string=w272)
        Concatenate Strings("@SERV 13 ", w272, "#") -> w273
        call "VISA ReadWrite.gvi"(VISA_IN=w271, CMD=w273, ERROR_IN=w269) -> (ERROR_OUT=w81)
        w82 = s3
        w83 = default
      }
      frame "Brightness Config" {
        Property Node(instance in=s4) -> ("VISA Resource"=w274, instance out=w84)
        call "Enqueue Message (Single).gvi"(message queue in=w77, message="Prepare CVM", error in=w80) -> (error out=w275)
        Variant To Data(error in (no error)=w275, type=u32 0, variant=w79) -> (data=w276, error out=w277)
        # Set brightness limits
        In Range And Coerce(lower limit=0, upper limit=100, x=w276) -> (coerced(x)=w278)
        Number To Decimal String(number=w278) -> (decimal integer string=w279)
        Concatenate Strings("@DIM 6 ", w279, "#") -> w280
        call "VISA ReadWrite.gvi"(VISA_IN=w274, CMD=w280, ERROR_IN=w277) -> (ERROR_OUT=w81)
        w82 = s3
        w83 = default
      }
      frame "IR Thermometer Position" {
        Variant To Data(error in (no error)=w80, type=string "", variant=w79) -> (data=w281, error out=w282)
        case (w281) {
          frame "None", Default {
            w283 = "@SERV 5 0#"
            w284 = w281
          }
          frame "Panel 1" {
            w283 = "@SERV 5 50#"
            w284 = w281
          }
          frame "Panel 2" {
            w283 = "@SERV 5 75#"
            w284 = w281
          }
          frame "Panel 3" {
            w283 = "@SERV 5 110#"
            w284 = w281
          }
          frame "Panel 4" {
            w283 = "@SERV 5 130#"
            w284 = w281
          }
        }
        Property Node(instance in=reference to "PV-Temperature IR Position", "ValueSignaling"=w284)
        Property Node(instance in=s4) -> ("VISA Resource"=w285, instance out=w84)
        call "VISA ReadWrite.gvi"(VISA_IN=w285, CMD=w283, ERROR_IN=w282) -> (ERROR_OUT=w81)
        w82 = s3
        w83 = default
      }
      frame "Set LoadR" {
        Property Node(instance in=s4) -> ("VISA Resource"=w286, instance out=w84)
        call "Enqueue Message (Single).gvi"(message queue in=w77, message="Prepare CVM", error in=w80) -> (error out=w287)
        Variant To Data(error in (no error)=w287, type=string "", variant=w79) -> (data=w288, error out=w289)
        # Disconnect ALL load
        w290 = ["@DO 42 1#", "@DO 34 0#", "@DO 35 0#", "@DO 36 0#", "@DO 37 0#", "@DO 38 0#", "@DO 39 0#", "@DO 40 0#", "@DO 41 0#", "@DO 43 0#", "@DO 44 0#", "@DO 45 0#", "@DO 46 0#", "@DO 47 0#", "@DO 48 0#", "@DO 49 0#"]
        sequence {
          frame 0 {
            call "VISA Multiple Write.gvi"(VISA_IN=w286, ARRAY_IN=w290, ERROR_IN=w289) -> (VISA_OUT=w291, ERROR_OUT=w292)
            $"Total Set LoadR" <- 1
          }
        }
        s5 = w288  # shift register
        s6 = 0  # shift register
        s7 = ""  # shift register
        while {
          Match Pattern(regular expression=",", string=s5) -> (after substring=w293, before substring=w294)
          s8 = w294  # shift register
          s9 = s6  # shift register
          while {
            Match Pattern(regular expression=",", string=s8) -> (after substring=w295, before substring=w296)
            case (w296) {
              frame "1" {
                call "VISA ReadWrite.gvi"(VISA_IN=w291, CMD="@DO 43 1#", ERROR_IN=w292) -> (ERROR_OUT=w297)
                w298 = w296
              }
              frame "2" {
                call "VISA ReadWrite.gvi"(VISA_IN=w291, CMD="@DO 44 1#", ERROR_IN=w292) -> (ERROR_OUT=w297)
                w298 = w296
              }
              frame "3" {
                call "VISA ReadWrite.gvi"(VISA_IN=w291, CMD="@DO 45 1#", ERROR_IN=w292) -> (ERROR_OUT=w297)
                w298 = w296
              }
              frame "5" {
                call "VISA ReadWrite.gvi"(VISA_IN=w291, CMD="@DO 46 1#", ERROR_IN=w292) -> (ERROR_OUT=w297)
                w298 = w296
              }
              frame "10" {
                call "VISA ReadWrite.gvi"(VISA_IN=w291, CMD="@DO 47 1#", ERROR_IN=w292) -> (ERROR_OUT=w297)
                w298 = w296
              }
              frame "20" {
                call "VISA ReadWrite.gvi"(VISA_IN=w291, CMD="@DO 48 1#", ERROR_IN=w292) -> (ERROR_OUT=w297)
                w298 = w296
              }
              frame "40" {
                call "VISA ReadWrite.gvi"(VISA_IN=w291, CMD="@DO 49 1#", ERROR_IN=w292) -> (ERROR_OUT=w297)
                w298 = w296
              }
              frame "50" {
                call "VISA ReadWrite.gvi"(VISA_IN=w291, CMD="@DO 34 1#", ERROR_IN=w292) -> (ERROR_OUT=w297)
                w298 = w296
              }
              frame "100" {
                call "VISA ReadWrite.gvi"(VISA_IN=w291, CMD="@DO 35 1#", ERROR_IN=w292) -> (ERROR_OUT=w297)
                w298 = w296
              }
              frame "200" {
                call "VISA ReadWrite.gvi"(VISA_IN=w291, CMD="@DO 36 1#", ERROR_IN=w292) -> (ERROR_OUT=w297)
                w298 = w296
              }
              frame "400" {
                call "VISA ReadWrite.gvi"(VISA_IN=w291, CMD="@DO 37 1#", ERROR_IN=w292) -> (ERROR_OUT=w297)
                w298 = w296
              }
              frame "500" {
                call "VISA ReadWrite.gvi"(VISA_IN=w291, CMD="@DO 38 1#", ERROR_IN=w292) -> (ERROR_OUT=w297)
                w298 = w296
              }
              frame "1000" {
                call "VISA ReadWrite.gvi"(VISA_IN=w291, CMD="@DO 39 1#", ERROR_IN=w292) -> (ERROR_OUT=w297)
                w298 = w296
              }
              frame "2000" {
                call "VISA ReadWrite.gvi"(VISA_IN=w291, CMD="@DO 40 1#", ERROR_IN=w292) -> (ERROR_OUT=w297)
                w298 = w296
              }
              frame "4000" {
                call "VISA ReadWrite.gvi"(VISA_IN=w291, CMD="@DO 41 1#", ERROR_IN=w292) -> (ERROR_OUT=w297)
                w298 = w296
              }
              frame "0", Default {
                # Short Circut
                # Схема сопротивления
                # 1 Ом + 1 Ом токовый резистор
                w297 = w292
                w298 = "Short Circuit (<1 Ohm)"
              }
            }
            Decimal String To Number(string=w298) -> (number=w299)
            Add(w299, s9) -> w300
            $"Total Set LoadR" <- w300
            Concatenate Strings(s7, ",", w298) -> w301
            $"Total LoadR_SET" <- w301
            Is Empty String Or Path(string/path=w295) -> w302
            next s8 = w295
            next s9 = w300
            stop if w302
          }
          Is Empty String Or Path(string/path=w293) -> w303
          next s5 = w293
          next s6 = s9
          next s7 = w301
          stop if w303
        }
        # Connect Load
        call "VISA ReadWrite.gvi"(VISA_IN=w286, CMD="@DO 42 0#", ERROR_IN=w297) -> (ERROR_OUT=w81)
        $"Total Set LoadR" <- s6
        Property Node(instance in=reference to "PV-LoadR,Ohm", "ValueSignaling"=s6)
        $"Total LoadR_SET" <- s7
        Property Node(instance in=reference to "PV-LoadRTotal", "ValueSignaling"=s7)
        w82 = s3
        w83 = default
      }
      frame "NoLoad" {
        # Сопротивление в начальное положение
        Property Node(instance in=reference to "PV-LoadRTotal", "ValueSignaling"="Disconnected (NO LOAD)")
        Property Node(instance in=reference to "Set LoadRTotal", "Value"="")
        $"Total LoadR_SET" <- "Disconnected (NO LOAD)"
        Property Node(instance in=reference to "PV-LoadR,Ohm", "ValueSignaling"=-1)
        $"Total Set LoadR" <- -1
        Property Node(instance in=s4) -> ("VISA Resource"=w304, instance out=w84)
        call "Enqueue Message (Single).gvi"(message queue in=w77, message="Prepare CVM", error in=w80) -> (error out=w305)
        # Disconnect all Load adn breake circuit
        # NO LOAD
        # Размыкаются всё реле, сопротивление- бесконечность
        w306 = ["@DO 42 1#", "@DO 34 1#", "@DO 35 1#", "@DO 36 1#", "@DO 37 1#", "@DO 38 1#", "@DO 39 1#", "@DO 40 1#", "@DO 41 1#", "@DO 43 1#", "@DO 44 1#", "@DO 45 1#", "@DO 46 1#", "@DO 47 1#", "@DO 48 1#", "@DO 49 1#"]
        call "VISA Multiple Write.gvi"(VISA_IN=w304, ARRAY_IN=w306, ERROR_IN=w305) -> (ERROR_OUT=w81)
        w82 = s3
        w83 = default
      }
      frame "Error" {
        Variant To Data(error in (no error)=w80, type=no error, variant=w79) -> (data=w307, error out=w81)
        # #CodeRecommended - If you ever change the name of this "Error" message, you'll need to update the name in the Check Loop Error.vi as well.
        call "Display Error.gvi"(error in=w307)
        w82 = s3
        w83 = default
        w84 = s4
      }
      frame "Exit" {
        Generate User Event(event data=TRUE, user event=w26) -> (error out=w308)
        Release Queue(error in=w80, queue=w77) -> (error out=w309)
        Property Node(instance in=s4) -> ("VISA Resource"=w310, "Physical Channel"=w311)
        call "DAQmx Stop Task.gvi"(task in=w311) -> (error out=w312)
        call "Close (Instr).gvi"(session in=w310, error in=w312) -> (error out=w313)
        Merge Errors(w313, w308, w309) -> (error out=w81)
        w82 = s3
        w83 = TRUE
        w84 = default
      }
      frame Default {
        w314 = "The invalid message string \"%s\" was received in the Message Handling Loop."
        Format Into String(formatString=w314, w78) -> w315
        call "Build Error Cluster.gvi"(code=1, description=w315) -> (error out=w81)
        w82 = s3
        w83 = default
        w84 = s4
      }
    }
    call "Error Handler - Message Handling Loop.gvi"(message queue in=w77, error in=w81) -> (dup error in=w316)
    next s3 = w82
    next s4 = w84
    stop if w83
  }
  $"Server URL" <- "https://api.systemlinkcloud.com/"
  $"Exit 2" <- FALSE
  $SendArrayDoubleToCloud <- "Send Measured Data To Cloud"
  $SendStringToCloud <- "Send String To Cloud"
  $SendDoubleToCloud <- "Send Double To Cloud"
  w317 = bool FALSE  # Stop Event
  Create User Event[EventName="Stop Event"](user event data type=w317) -> (error out=w318, user event out=w319)
  call "Create All Message Queues.gvi"(error in=w318) -> (message queues=w320, error out=w321)
  Property Node(instance in=w320) -> ("UI"=w322)
  s10 = "UI Data.gtype" {all zero or empty}  # shift register
  while {
    call "Dequeue Message.gvi"(message queue in=w322, error in=w321) -> (message queue out=w323, message=w324, message data=w325, error out=w326)
    # s10: Data
    # w319: Stop Event
    case (w324) ignore case {  # Message Cases
      frame "Initialize" {
        Property Node(instance in=s10, "String"=w324) -> (instance out=w328)
        call "Enqueue Message (Single).gvi"(message queue in=w323, message="Update Display", message data=w324, error in=w326) -> (message queue out=w330, error out=w331)
        # Bundle a sample string value.
        call "Enqueue Message (Single).gvi"(message queue in=w330, message=$SendArrayDoubleToCloud, error in=w331) -> (error out=w327)
        Property Node(instance in=reference to "PV-Temperature, ºC", "ValueSignaling"=0)
        Property Node(instance in=reference to "MV-Panel Configuration", "Value"="none")
        Property Node(instance in=reference to "PV-Panel Cofiguration", "ValueSignaling"="none")
        Property Node(instance in=reference to "MV-Heating", "Value"="none")
        Property Node(instance in=reference to "PV-Temperature IR, ºC", "ValueSignaling"=0)
        Property Node(instance in=reference to "PV-Heating", "ValueSignaling"="none")
        Property Node(instance in=reference to "MV-Cooling", "Value"="none")
        Property Node(instance in=reference to "PV-LightIntensity, W/m2", "ValueSignaling"=0)
        Property Node(instance in=reference to "PV-Cooling", "ValueSignaling"="none")
        Property Node(instance in=reference to "MV-Light Power", "Value"="none")
        Property Node(instance in=reference to "PV-Panel Tilt Angle, º", "ValueSignaling"=0)
        Property Node(instance in=reference to "PV-Optical Filter", "ValueSignaling"="none")
        Property Node(instance in=reference to "MV-Optical Filter", "Value"="none")
        Property Node(instance in=reference to "PV-LigthPower, %", "ValueSignaling"=0)
        Property Node(instance in=reference to "PV-LoadR4", "ValueSignaling"="none")
        Property Node(instance in=reference to "MV-Panel Tilt Angle", "Value"="none")
        Property Node(instance in=reference to "PV-Voltage, V", "ValueSignaling"=0)
        Property Node(instance in=reference to "PV-LoadR3", "ValueSignaling"="none")
        Property Node(instance in=reference to "MV-LoadR1", "Value"="none")
        Property Node(instance in=reference to "PV-LoadR2", "ValueSignaling"="none")
        Property Node(instance in=reference to "PV-Current, mA", "ValueSignaling"=0)
        Property Node(instance in=reference to "MV-LoadR2", "Value"="none")
        Property Node(instance in=reference to "PV-LoadR1", "ValueSignaling"="none")
        Property Node(instance in=reference to "PV-LoadR,Ohm", "ValueSignaling"=0)
        Property Node(instance in=reference to "MV-LoadR3", "Value"="none")
        Property Node(instance in=reference to "PV-LoadRTotal", "ValueSignaling"="none")
        Property Node(instance in=reference to "MV-LoadR4", "Value"="none")
        Property Node(instance in=reference to "MV-LoadRTotal", "Value"="none")
        w329 = default
      }
      frame "Something" {
        # #CodeNeeded - Perform whatever actions correspond to the "Something" message.
        # Send string to "Update Display" message
        call "Enqueue Message (Single).gvi"(message queue in=w323, message="Update Display", message data="\"Do Something\" button pressed", error in=w326) -> (error out=w327)
        w328 = s10
        w329 = default
      }
      frame "Something Else" {
        # #CodeNeeded - Perform whatever actions correspond to the "Something Else" message.
        # Send string to "Update Display" message
        call "Enqueue Message (Single).gvi"(message queue in=w323, message="Update Display", message data="\"Do Something Else\" button pressed", error in=w326) -> (error out=w327)
        w328 = s10
        w329 = default
      }
      frame "Update Display" {
        # #CodeRecommended - If you wish to decouple the Message Handling Loop from your user interface, consider creating User Events (like the "Stop" event in this VI) to message the Event Handling Loop whenever the user interface needs updating.
        Variant To Data(error in (no error)=w326, type=string "", variant=w325) -> (data=w332, error out=w327)
        $"Status of Send to SystemLink Cycle" <- w332
        w328 = s10
        w329 = default
      }
      frame "Error" {
        Variant To Data(error in (no error)=w326, type=no error, variant=w325) -> (data=w333, error out=w327)
        # #CodeRecommended - Consider creating a system for logging errors in some way. These errors are for notification purposes only. Handling of specific errors should be performed in the message frames that generated the error.
        # #CodeRecommended - If you ever change the name of this "Error" message, you'll need to update the name in the Check Loop Error.vi as well.
        call "Display Error.gvi"(error in=w333)
        w328 = s10
        w329 = default
      }
      frame "---Copy This Frame---" {
        Merge Errors(w326) -> (error out=w327)
        w328 = s10
        w329 = default
      }
      frame "Exit" {
        # Release the message queue reference
        Release Queue(error in=w326, queue=w323) -> (error out=w334)
        # #CodeNeeded - Add any required cleanup code here. Note that if 'Exit' was called as a result of an error, an error dialog will be displayed. Add any custom error handling for an 'Exit' condition here as well.
        Generate User Event(event data=TRUE, user event=w319) -> (error out=w335)
        Merge Errors(w335, w334) -> (error out=w327)
        # Stop the VI
        $"Exit 2" <- TRUE
        w328 = s10
        w329 = TRUE
      }
      frame Default {
        w336 = "The invalid message string \"%s\" was received in the Message Handling Loop."
        Format Into String(formatString=w336, w324) -> w337
        call "Build Error Cluster.gvi"(code=1, description=w337) -> (error out=w327)
        w328 = s10
        w329 = default
      }
      frame "Send Double To Cloud" {
        Property Node(instance in=s10, "String"=w324) -> (instance out=w328)
        call "Open Configuration API Key.gvi"(server url=$"Server URL", api key=$"API Key", error in=w326) -> (configuration=w338)
        Variant To Data(type=string[] [], variant=w325) -> (data=w339)
        Array Index(array=w339) -> (out0[0]=w340, out1[1]=w341)
        Floating Point String To Number(string=w341) -> (number=w342)
        Build Array(w340) -> w343
        call "Query Tags.gvi"(paths=w343, configuration=w338) -> (tags=w344, error out=w345)
        Array Index(array=w344) -> (out0[_]=w346)
        Property Node(instance in=w346) -> ("Path"=w347, "Datatype"=w348)
        call "Open Tag.gvi"(path=w347, data type=w348, error in=w345, configuration=w338) -> (tag=w349, error out=w350)
        call "Write Tag (DBL).gvi"(tag in=w349, value=w342, error in=w350) -> (tag out=w351, error out=w352)
        call "Close Tag (Single).gvi"(tag=w351, error in=w352) -> (error out=w353)
        call "Close Configuration.gvi"(configuration=w338, error in=w353) -> (error out=w327)
        call "Enqueue Message (Single).gvi"(message queue in=w323, message="Update Display", message data=w324)
        w329 = default
      }
      frame "Send Measured Data To Cloud" {
        Property Node(instance in=s10, "String"=w324) -> (instance out=w328)
        call "Enqueue Message (Single).gvi"(message queue in=w323, message="Update Display", message data=w324, error in=w326) -> (message queue out=w354, error out=w355)
        call "Enqueue Message (Single).gvi"(message queue in=w354, message=$SendArrayDoubleToCloud, error in=w355) -> (error out=w356)
        call "Open Configuration API Key.gvi"(server url=$"Server URL", api key=$"API Key", error in=w356) -> (configuration=w357, error out=w358)
        w359 = ["PV-Current", "PV-Voltage", "PV-LigthtIntensity", "PV-Temperature"]
        call "Query Tags.gvi"(paths=w359, error in=w358, configuration=w357) -> (tags=w360, error out=w361)
        Property Node(instance in=$"Measured Data") -> ("Voltage, V"=w362, "Current, mA"=w363, "Luminous Flux, Lux"=w364, "Temperature, GradC"=w365)
        Build Array(w362, w363, w364, w365) -> w366
        for {
          w367 = each element of w360
          w368 = each element of w366
          Property Node(instance in=w367) -> ("Path"=w369, "Datatype"=w370)
          call "Open Tag.gvi"(path=w369, data type=w370, error in=w361, configuration=w357) -> (tag=w371, error out=w372)
          call "Write Tag (DBL).gvi"(tag in=w371, value=w368, error in=w372) -> (error out=w373)
        }
        for {
          w374 = each element of w360
          call "Close Tag (Single).gvi"(tag=w374, error in=w373) -> (error out=w375)
        }
        call "Close Configuration.gvi"(configuration=w357, error in=w375) -> (error out=w327)
        w329 = default
      }
      frame "Send String To Cloud" {
        Property Node(instance in=s10, "String"=w324) -> (instance out=w328)
        call "Open Configuration API Key.gvi"(server url=$"Server URL", api key=$"API Key", error in=w326) -> (configuration=w376, error out=w377)
        Variant To Data(type=string[] [], variant=w325) -> (data=w378)
        Array Index(array=w378) -> (out0[0]=w379, out1[1]=w380)
        Build Array(w379) -> w381
        call "Query Tags.gvi"(paths=w381, configuration=w376) -> (tags=w382)
        Array Index(array=w382) -> (out0[_]=w383)
        Property Node(instance in=w383) -> ("Path"=w384, "Datatype"=w385)
        call "Open Tag.gvi"(path=w384, data type=w385, error in=w377, configuration=w376) -> (tag=w386, error out=w387)
        call "Write Tag (String).gvi"(tag in=w386, value=w380, error in=w387) -> (tag out=w388, error out=w389)
        call "Close Tag (Single).gvi"(tag=w388, error in=w389) -> (error out=w390)
        call "Close Configuration.gvi"(configuration=w376, error in=w390) -> (error out=w327)
        call "Enqueue Message (Single).gvi"(message queue in=w323, message="Update Display", message data=w324)
        w329 = default
      }
    }
    call "Error Handler - Message Handling Loop.gvi"(message queue in=w323, error in=w327) -> (dup error in=w391)
    next s10 = w328
    stop if w329
  }
  Register For Events("Stop Event"=w319) -> (event registration refnum out=w392)
  s11 = w392  # shift register
  while {
    event (dynamic events = s11) {
      on "Do Something" Value changed {
        # #CodeNeeded - Send the appropriate message for this user interface event.
        call "Enqueue Message (Single).gvi"(message queue in=w322, message="Something") -> (message queue out=w395, error out=w394)
        w393 = default
      }
      on "Do Something Else" Value changed {
        # #CodeNeeded - Send the appropriate message for this user interface event.
        call "Enqueue Message (Single).gvi"(message queue in=w322, message="Something Else") -> (message queue out=w395, error out=w394)
        w393 = default
      }
      on "Exit" Value changed {
        call "Enqueue Message (Single).gvi"(priority message=TRUE, message queue in=w322, message="Exit") -> (message queue out=w395, error out=w394)
        w393 = default
      }
      on dynamic event 0 {
        # The Message Handling Loop processed an "Exit" message, which fired this event to stop the Event Handling Loop.
        $"Status of Send to SystemLink Cycle" <- "\"Exit\" button pressed"
        w393 = TRUE
        w394 = default
        w395 = w322
      }
      on "Window" Close? {
        call "Enqueue Message (Single).gvi"(priority message=TRUE, message queue in=w322, message="Exit") -> (message queue out=w395)
        Event Filter("Discard?"=TRUE)
        w393 = default
        w394 = default
      }
      on "PV-Current, mA" Value changed {
        Event Data() -> ("New Value"=w396)
        Number To Fractional String(number=w396) -> (F-format string=w397)
        Build Array("PV-Current", w397) -> w398
        call "Enqueue Message (Single).gvi"(message queue in=w322, message=$SendDoubleToCloud, message data=w398) -> (message queue out=w395, error out=w394)
        w393 = default
      }
      on "PV-LoadR,Ohm" Value changed {
        Event Data() -> ("New Value"=w399)
        Number To Fractional String(number=w399) -> (F-format string=w400)
        Build Array("PV-LoadR", w400) -> w401
        call "Enqueue Message (Single).gvi"(message queue in=w322, message=$SendDoubleToCloud, message data=w401) -> (message queue out=w395, error out=w394)
        w393 = default
      }
      on "PV-Voltage, V" Value changed {
        Event Data() -> ("New Value"=w402)
        Number To Fractional String(number=w402) -> (F-format string=w403)
        Build Array("PV-Voltage", w403) -> w404
        call "Enqueue Message (Single).gvi"(message queue in=w322, message=$SendDoubleToCloud, message data=w404) -> (message queue out=w395, error out=w394)
        w393 = default
      }
      on "PV-Temperature, ºC" Value changed {
        Event Data() -> ("New Value"=w405)
        Number To Fractional String(number=w405) -> (F-format string=w406)
        Build Array("PV-Temperature", w406) -> w407
        call "Enqueue Message (Single).gvi"(message queue in=w322, message=$SendDoubleToCloud, message data=w407) -> (message queue out=w395, error out=w394)
        w393 = default
      }
      on "PV-Temperature IR, ºC" Value changed {
        Event Data() -> ("New Value"=w408)
        Number To Fractional String(number=w408) -> (F-format string=w409)
        Build Array("PV-Temperature IR", w409) -> w410
        call "Enqueue Message (Single).gvi"(message queue in=w322, message=$SendDoubleToCloud, message data=w410) -> (message queue out=w395, error out=w394)
        w393 = default
      }
      on "PV-LightIntensity, W/m2" Value changed {
        Event Data() -> ("New Value"=w411)
        Number To Fractional String(number=w411) -> (F-format string=w412)
        Build Array("PV-LigthtIntensity", w412) -> w413
        call "Enqueue Message (Single).gvi"(message queue in=w322, message=$SendDoubleToCloud, message data=w413) -> (message queue out=w395, error out=w394)
        w393 = default
      }
      on "PV-LigthPower, %" Value changed {
        Event Data() -> ("New Value"=w414)
        Number To Fractional String(number=w414) -> (F-format string=w415)
        Build Array("PV-LigthtPower", w415) -> w416
        call "Enqueue Message (Single).gvi"(message queue in=w322, message=$SendDoubleToCloud, message data=w416) -> (message queue out=w395, error out=w394)
        w393 = default
      }
      on "PV-Panel Tilt Angle, º" Value changed {
        Event Data() -> ("New Value"=w417)
        Number To Fractional String(number=w417) -> (F-format string=w418)
        Build Array("PV-Panel Tilt Angle", w418) -> w419
        call "Enqueue Message (Single).gvi"(message queue in=w322, message=$SendDoubleToCloud, message data=w419) -> (message queue out=w395, error out=w394)
        w393 = default
      }
      on "PV-Panel Cofiguration" Value changed {
        Event Data() -> ("New Value"=w420)
        Build Array("PV-Panel Configuration", w420) -> w421
        call "Enqueue Message (Single).gvi"(message queue in=w322, message=$SendStringToCloud, message data=w421) -> (message queue out=w395, error out=w394)
        w393 = default
      }
      on "PV-Temperature IR Position" Value changed {
        Event Data() -> ("New Value"=w422)
        Build Array("PV-Temperature IR Position", w422) -> w423
        call "Enqueue Message (Single).gvi"(message queue in=w322, message=$SendStringToCloud, message data=w423) -> (message queue out=w395, error out=w394)
        w393 = default
      }
      on "PV-Cooling" Value changed {
        Event Data() -> ("New Value"=w424)
        Build Array("PV-Cooling", w424) -> w425
        call "Enqueue Message (Single).gvi"(message queue in=w322, message=$SendStringToCloud, message data=w425) -> (message queue out=w395, error out=w394)
        w393 = default
      }
      on "PV-Heating" Value changed {
        Event Data() -> ("New Value"=w426)
        Build Array("PV-Heating", w426) -> w427
        call "Enqueue Message (Single).gvi"(message queue in=w322, message=$SendStringToCloud, message data=w427) -> (message queue out=w395, error out=w394)
        w393 = default
      }
      on "PV-Optical Filter" Value changed {
        Event Data() -> ("New Value"=w428)
        Build Array("PV-Optical Filter", w428) -> w429
        call "Enqueue Message (Single).gvi"(message queue in=w322, message=$SendStringToCloud, message data=w429) -> (message queue out=w395, error out=w394)
        w393 = default
      }
      on "PV-LoadR1" Value changed {
        Event Data() -> ("New Value"=w430)
        Build Array("PV-LoadR1", w430) -> w431
        call "Enqueue Message (Single).gvi"(message queue in=w322, message=$SendStringToCloud, message data=w431) -> (message queue out=w395)
        w393 = default
        w394 = default
      }
      on "PV-LoadR2" Value changed {
        Event Data() -> ("New Value"=w432)
        Build Array("PV-LoadR2", w432) -> w433
        call "Enqueue Message (Single).gvi"(message queue in=w322, message=$SendStringToCloud, message data=w433) -> (message queue out=w395)
        w393 = default
        w394 = default
      }
      on "PV-LoadR3" Value changed {
        Event Data() -> ("New Value"=w434)
        Build Array("PV-LoadR3", w434) -> w435
        call "Enqueue Message (Single).gvi"(message queue in=w322, message=$SendStringToCloud, message data=w435) -> (message queue out=w395)
        w393 = default
        w394 = default
      }
      on "PV-LoadR4" Value changed {
        Event Data() -> ("New Value"=w436)
        Build Array("PV-LoadR4", w436) -> w437
        call "Enqueue Message (Single).gvi"(message queue in=w322, message=$SendStringToCloud, message data=w437) -> (message queue out=w395)
        w393 = default
        w394 = default
      }
      on "PV-LoadRTotal" Value changed {
        Event Data() -> ("New Value"=w438)
        Build Array("PV-LoadRTotal", w438) -> w439
        call "Enqueue Message (Single).gvi"(message queue in=w322, message=$SendStringToCloud, message data=w439) -> (message queue out=w395)
        w393 = default
        w394 = default
      }
    }
    call "Error Handler - Event Handling Loop.gvi"(message queue in=w395, error in=w394) -> (dup error in=w440)
    stop if w393
  }
  Unregister For Events(error in=w440, event registration refnum=s11) -> (error out=w441)
  Merge Errors(w441, w391) -> (error out=w442)
  Destroy User Event(error in=w442, user event=w319)
  disable {
    frame Enabled { }
    frame Disabled {
      call "Initialize.gvi"(device name="cam0") -> (session out=w443, error out=w444)
      call "Configure Grab.gvi"(session in=w443, error in=w444) -> (session out=w445, error out=w446)
      call "Create Image.gvi"(image name="image_1") -> (new image=w447)
      while {
        call "Grab.gvi"(session in=w445, error in=w446, image in=w447) -> (session out=w448, error out=w449)
        stop if $Stop
      }
      call "Close.gvi"(session=w448, error in=w449)
    }
  }
