vi "Main.gvi"   [LabVIEW NXG 5.0.0]
# This template is for the Queued Message Handler design pattern.
# The Event Handling Loop generates messages based on user interface actions.
# The Message Handling Loop processes messages generated by the Event Handling Loop, or by other messages.  The messages are string values, so new messages can be added easily to the Message Cases case structure in the Message Handling Loop.  Each message cluster can also provide an optional value for Message Data, which is a variant that can be converted to whatever message-specific data is required.
panel controls:
  "Exit": bool
  "TEMP Button": bool
  "LUX Button": bool
  "VISA Resource Name": "VISA Instr" = "COM5"
  "Initialize VISA": bool
  "CMD Button": bool
  "Initialize AI": bool
  "PV Config Button": bool
  "Set PV Angle Button": bool
  "IR Thermometer Config Button": bool
  "Fans Button": bool
  "Brightness Config Button": bool
  "Optic Filter Config Button": bool
  "Reset CVM Button": bool
  "Stop": bool
  "PV Config Selector": string
  "PV Angle": i32
  "Fans Selector": string
  "Optic Filter Selector": string
  "IR Thermometer Selector": string
  "Brightness": i32
  "Prepare CVM": bool
  "Command to Arduino": string = "@DO 34 0#"
  "Set LoadR": bool
  "Reset LoadR": bool
  "Total LoadR: R Values separated by coma": string
  "VAC Button": bool
  "Heat Selector": string
  "Heat Button": bool
  "Exit 2": bool
  "Do Something": bool
  "Do Something Else": bool
  "PV-Current, mA": f64
  "PV-LoadR,Ohm": f64
  "PV-Voltage, V": f64
  "PV-Temperature, ºC": f64
  "PV-LightIntensity, W/m2": f64
  "PV-Panel Tilt Angle, º": f64
  "PV-Panel Cofiguration": string
  "PV-Cooling": string
  "PV-Heating": string
  "PV-Optical Filter": string
  "PV-LoadR1": string
  "PV-LoadR2": string
  "PV-LoadR3": string
  "PV-LoadR4": string
  "Tab": i32
  "MeasuredData": f64[]
panel indicators:
  "Display": string
  "Command reply": "ArduinoReply.gtype"
  "Reply LUX": "ArduinoReply.gtype"
  "Reply TEMP": "ArduinoReply.gtype"
  "AI measurements": waveform<f64>[]
  "Hardware Current Status": string
  "Voltage coeff": f64
  "Current coeff": f64
  "Recalculated Voltage": f64
  "Recalculated Current": f64
  "VAC Load Counter": i32
  "Voltage_Graph": f64[]
  "Output": error
  "VISA Answer_2": "ArduinoReply.gtype"[]
  "VISA Answer": "ArduinoReply.gtype"[]
  "Current_Graph": f64[]
  "VAC": cluster{"Element 1": f64[], "Element 2": f64[]}
  "Status PV Config": string
  "PV-Connecting Solar Panels": string
  "CMD TIME": "ArduinoReply.gtype"
  "MV-Panel Configuration": string
  "MV-Cooling": string
  "MV-Heating": string
  "MV-Optical Filter": string
  "MV-Panel Tilt Angle": string
  "MV-Light Power": string
  "MV-LoadR1": string
  "MV-LoadR2": string
  "MV-LoadR3": string
  "MV-LoadR4": string
  "API Key": string
  "Server URL": string
  "Status of Send to SystemLink Cycle": string
  "SendDoubleToCloud": string
  "SendStringToCloud": string
  "Error out Systemlink Read Cycle": error
  "Reply Arduino Status": "ArduinoReply.gtype"
  "Voltage MidPoint": f64
  "Current MidPoint": f64
  "Arduino Status": string
  "SendArrayDoubleToCloud": string
  "TempSensor": f64
  "LuxSensor": f64
  "TempSensor Reply": string
  "LuxSensor Reply": string
types:
  "ArduinoReply.gtype" = cluster{"Timestamp": timestamp, "DATA": string}
  T1 = cluster{"VISA Resource": "VISA Instr", "Physical Channel": "DAQmx Task"}
  "UI Data.gtype" = cluster{"Boolean": bool, "String": string, "Numeric": f64}
  "ValueRange.gtype" = cluster{"maximum value": f64, "minimum value": f64}
uses:
  NI::Skyline::Configuration::Open Configuration API Key.gvi
  NI::Skyline::TagHTTP::Query Tags.gvi
  NI::Skyline::TagHTTP::Open Tag.gvi
  NI::Skyline::TagHTTP::Read Tag (String).gvi
  NI::Skyline::TagHTTP::Close Tag (Single).gvi
  NI::Skyline::Configuration::Close Configuration.gvi
  Message Queue::Create All Message Queues.gvi
  Message Queue::Enqueue Message (Single).gvi
  Support::Error Handler - Event Handling Loop.gvi
  Message Queue::Dequeue Message.gvi
  NI::VISA::Configure Serial Port (Instr).gvi
  NI::VISA::Open (Instr).gvi
  NI::DAQmx::Internal::DAQmx Create Channel (AI-Voltage-Basic).gvi
  Queued Message Handler::Read_Write_VISA.gvi
  NI::DAQmx::Internal::DAQmx Read (Analog 2D DBL NChan NSamp).gvi
  NI::DAQmx::Internal::DAQmx Read (Analog 1D Wfm NChan NSamp).gvi
  Queued Message Handler::PV_switch.gvi
  Queued Message Handler::CMD_Iteration.gvi
  NI::G Core::Error::Display Error.gvi
  NI::DAQmx::Internal::DAQmx Stop Task.gvi
  NI::VISA::Close (Instr).gvi
  NI::G Core::Error::Build Error Cluster.gvi
  Support::Error Handler - Message Handling Loop.gvi
  NI::Skyline::TagHTTP::Write Tag (DBL).gvi
  NI::Skyline::TagHTTP::Write Tag (String).gvi
  NI::Vision::IMAQdx::Initialize.gvi
  NI::Vision::IMAQdx::Configure Grab.gvi
  NI::Vision::Core::Basics::Create Image.gvi
  NI::Vision::IMAQdx::Grab.gvi
  NI::Vision::IMAQdx::Close.gvi
diagram:
  $"MV-Panel Configuration" <- ""
  $"MV-Cooling" <- ""
  $"MV-Heating" <- ""
  $"MV-Optical Filter" <- ""
  $"MV-Panel Tilt Angle" <- ""
  $"MV-Light Power" <- ""
  $"MV-LoadR1" <- ""
  $"MV-LoadR2" <- ""
  $"MV-LoadR3" <- ""
  $"MV-LoadR4" <- ""
  Array Size(array=["MV-Panels Configuration"]) -> (size(s)=w1)
  Initialize Array(element=1904-12-31T23:00:00Z, size=w1) -> w2
  sequence {
    frame 0 {
      Wait(time to wait=20000)
    }
  }
  s1 = w2  # shift register
  while {
    Wait(time to wait=500)
    call "Open Configuration API Key.gvi"(server url=$"Server URL", api key=$"API Key") -> (configuration=w3, error out=w4)
    call "Query Tags.gvi"(paths=["MV-Panels Configuration"], error in=w4, configuration=w3) -> (tags=w5, error out=w6)
    Build Array(reference to "MV-Panel Configuration", reference to "MV-Cooling", reference to "MV-Heating", reference to "MV-Optical Filter", reference to "MV-Panel Tilt Angle", reference to "MV-Light Power", reference to "MV-LoadR1", reference to "MV-LoadR2", reference to "MV-LoadR3", reference to "MV-LoadR4") -> w7
    for {
      w8 = each element of w5
      w9 = each element of s1
      w10 = each element of w7
      Property Node(instance in=w8) -> ("Path"=w12, "Datatype"=w13)
      call "Open Tag.gvi"(path=w12, data type=w13, error in=w6, configuration=w3) -> (tag=w14, error out=w15)
      call "Read Tag (String).gvi"(tag in=w14, error in=w15) -> (value=w16, time stamp=w17, error out=w18)
      Is Greater(x=w17, y=w9) -> w19
      case (w19) {
        frame False, Default { }
        frame True {
          Property Node(instance in=w10, "ValueSignaling"=w16)
        }
      }
      append w17 to w11
    }
    for {
      w20 = each element of w5
      call "Close Tag (Single).gvi"(tag=w20, error in=w18) -> (error out=w21)
    }
    call "Close Configuration.gvi"(configuration=w3, error in=w21) -> (error out=w22)
    $"Error out Systemlink Read Cycle" <- w22
    next s1 = w11
    stop if $"Exit 2"
  }
  $"PV-Connecting Solar Panels" <- ""
  disable {
    frame Enabled { }
    frame Disabled {
      Destroy User Event()
    }
  }
  w23 = bool FALSE  # Stop Event
  Create User Event[EventName="Stop Event"](user event data type=w23) -> (error out=w24, user event out=w25)
  Register For Events("Stop Event"=w25) -> (event registration refnum out=w26)
  call "Create All Message Queues.gvi"(error in=w24) -> (message queues=w27, error out=w28)
  Property Node(instance in=w27) -> ("UI"=w29)
  s2 = w26  # shift register
  while {
    event (dynamic events = s2) {
      on "Exit" Value changed {
        call "Enqueue Message (Single).gvi"(priority message=TRUE, message queue in=w29, message="Exit") -> (message queue out=w32, error out=w31)
        w30 = default
      }
      on dynamic event 0 {
        $Display <- "\"Exit\" button pressed"
        w30 = TRUE
        w31 = default
        w32 = w29
      }
      on "Window" Close? {
        call "Enqueue Message (Single).gvi"(priority message=TRUE, message queue in=w29, message="Exit") -> (message queue out=w32)
        Event Filter("Discard?"=TRUE)
        w30 = default
        w31 = default
      }
      on "Initialize VISA" Value changed {
        call "Enqueue Message (Single).gvi"(message queue in=w29, message="Initialize VISA") -> (message queue out=w32, error out=w31)
        w30 = default
      }
      on "Initialize AI" Value changed {
        call "Enqueue Message (Single).gvi"(message queue in=w29, message="Initialize AI") -> (message queue out=w32, error out=w31)
        w30 = default
      }
      on "CMD Button" Value changed {
        call "Enqueue Message (Single).gvi"(message queue in=w29, message="Send CMD") -> (message queue out=w32, error out=w31)
        w30 = default
      }
      on "TEMP Button" Value changed {
        call "Enqueue Message (Single).gvi"(message queue in=w29, message="Get Temperature") -> (message queue out=w32, error out=w31)
        w30 = default
      }
      on "LUX Button" Value changed {
        call "Enqueue Message (Single).gvi"(message queue in=w29, message="Get Brightness") -> (message queue out=w32, error out=w31)
        w30 = default
      }
      on "Reset CVM Button" Value changed {
        call "Enqueue Message (Single).gvi"(message queue in=w29, message="Reset CVM") -> (message queue out=w32, error out=w31)
        w30 = default
      }
      on "PV Config Button" Value changed {
        call "Enqueue Message (Single).gvi"(message queue in=w29, message="PV Config", message data=$"PV Config Selector") -> (message queue out=w32, error out=w31)
        w30 = default
      }
      on "MV-Panel Configuration" Value changed {
        call "Enqueue Message (Single).gvi"(message queue in=w29, message="PV Config", message data=$"MV-Panel Configuration") -> (message queue out=w32, error out=w31)
        w30 = default
      }
      on "Heat Button" Value changed {
        call "Enqueue Message (Single).gvi"(message queue in=w29, message="Heat Config", message data=$"Heat Selector") -> (message queue out=w32, error out=w31)
        w30 = default
      }
      on "Set PV Angle Button" Value changed {
        call "Enqueue Message (Single).gvi"(message queue in=w29, message="Set PV Angle", message data=$"PV Angle") -> (message queue out=w32, error out=w31)
        w30 = default
      }
      on "IR Thermometer Config Button" Value changed {
        call "Enqueue Message (Single).gvi"(message queue in=w29, message="IR Thermometer", message data=$"IR Thermometer Selector") -> (message queue out=w32, error out=w31)
        w30 = default
      }
      on "Fans Button" Value changed {
        call "Enqueue Message (Single).gvi"(message queue in=w29, message="Fans Control", message data=$"Fans Selector") -> (message queue out=w32, error out=w31)
        w30 = default
      }
      on "Brightness Config Button" Value changed {
        call "Enqueue Message (Single).gvi"(message queue in=w29, message="Brightness Config", message data=$Brightness) -> (message queue out=w32, error out=w31)
        w30 = default
      }
      on "Optic Filter Config Button" Value changed {
        call "Enqueue Message (Single).gvi"(message queue in=w29, message="Optic Filter Config", message data=$"Optic Filter Selector") -> (message queue out=w32, error out=w31)
        w30 = default
      }
      on "Prepare CVM" Value changed {
        call "Enqueue Message (Single).gvi"(message queue in=w29, message="Prepare CVM") -> (message queue out=w32, error out=w31)
        w30 = default
      }
      on "Set LoadR" Value changed {
        call "Enqueue Message (Single).gvi"(message queue in=w29, message="Set Resistance", message data=$"Total LoadR: R Values separated by coma") -> (message queue out=w32, error out=w31)
        w30 = default
      }
      on "Reset LoadR" Value changed {
        call "Enqueue Message (Single).gvi"(message queue in=w29, message="Reset Resistance") -> (message queue out=w32, error out=w31)
        w30 = default
      }
      on "VAC Button" Value changed {
        Property Node(instance in=reference to "VAC")
        Get Current Time() -> (current time=w33)
        call "Enqueue Message (Single).gvi"(message queue in=w29, message="VAC", message data=w33) -> (message queue out=w32)
        $"VAC Load Counter" <- 0
        w30 = default
        w31 = default
      }
    }
    call "Error Handler - Event Handling Loop.gvi"(message queue in=w32, error in=w31) -> (dup error in=w34)
    stop if w30
  }
  Unregister For Events(error in=w34, event registration refnum=s2)
  $"API Key" <- "zYUbuW0YNkg1G__lXfJiGVBNWME-HlVd2a5NUHp-IP"
  s3 = "UI Data.gtype" {all zero or empty}  # shift register
  s4 = T1 {"VISA Resource"="COM5", "Physical Channel"=""}  # shift register
  while {
    call "Dequeue Message.gvi"(message queue in=w29, error in=w28) -> (message queue out=w35, message=w36, message data=w37, error out=w38)
    $"Hardware Current Status" <- w36
    # s3: Data
    # w25: Stop Event
    case (w36) ignore case {  # Message Cases
      frame "Initialize" {
        # set time
        #
        # NO initialase SLC
        call "Enqueue Message (Single).gvi"(message queue in=w35, message="Initialize VISA", error in=w38) -> (message queue out=w43, error out=w44)
        call "Enqueue Message (Single).gvi"(message queue in=w43, message="Initialize AI", error in=w44) -> (message queue out=w45, error out=w46)
        call "Enqueue Message (Single).gvi"(message queue in=w45, message="Set Time", error in=w46) -> (message queue out=w47, error out=w48)
        call "Enqueue Message (Single).gvi"(message queue in=w47, message="Reset CVM", error in=w48) -> (message queue out=w49, error out=w50)
        call "Enqueue Message (Single).gvi"(message queue in=w49, message="Fans Control", message data="Turn All Off", error in=w50) -> (message queue out=w51, error out=w52)
        call "Enqueue Message (Single).gvi"(message queue in=w51, message="Heat Config", message data="No Heat", error in=w52) -> (message queue out=w53, error out=w54)
        call "Enqueue Message (Single).gvi"(message queue in=w53, message="Optic Filter Config", message data="None", error in=w54) -> (message queue out=w55, error out=w56)
        call "Enqueue Message (Single).gvi"(message queue in=w55, message="Set PV Angle", message data=90, error in=w56) -> (message queue out=w57, error out=w58)
        call "Enqueue Message (Single).gvi"(message queue in=w57, message="PV Config", message data="Parallel 4", error in=w58) -> (message queue out=w59, error out=w60)
        call "Enqueue Message (Single).gvi"(message queue in=w59, message="Wait For Event", error in=w60) -> (error out=w39)
        w40 = s3
        w41 = default
        w42 = s4
      }
      frame "Initialize VISA" {
        call "Configure Serial Port (Instr).gvi"(stop bits="1.0"(10), session in=$"VISA Resource Name", baud rate=115200, parity="None"(0), termination char=0xA, enable termination char=TRUE) -> (session out=w61, error out=w62)
        call "Open (Instr).gvi"(resource name=w61, error in=w62) -> (session out=w63, error out=w64)
        Property Node(instance in=s4, "VISA Resource"=w63) -> (instance out=w42)
        Wait(time to wait=2000)
        Merge Errors(w64, w38) -> (error out=w39)
        w40 = s3
        w41 = default
      }
      frame "Initialize AI" {
        call "DAQmx Create Channel (AI-Voltage-Basic).gvi"(error in=w38, physical channels="Dev1/ai0:1,Dev1/ai3,Dev1/ai7", units="Volts"(10348), measurement range="ValueRange.gtype" {"maximum value"=10, "minimum value"=0}, input terminal configuration="RSE"(10083)) -> (task out=w65, error out=w39)
        Property Node(instance in=s4, "Physical Channel"=w65) -> (instance out=w42)
        w40 = s3
        w41 = default
      }
      frame "Wait For Event" {
        call "Enqueue Message (Single).gvi"(message queue in=w35, message="Watchdog", error in=w38) -> (error out=w39)
        w40 = s3
        w41 = default
        w42 = s4
      }
      frame "Send CMD" {
        Property Node(instance in=s4) -> ("VISA Resource"=w66, instance out=w42)
        call "Enqueue Message (Single).gvi"(message queue in=w35, message="Wait For Event", error in=w38) -> (error out=w67)
        call "Read_Write_VISA.gvi"(VISA_IN=w66, CMD=$"Command to Arduino", ERROR_IN=w67) -> (Arduino_Reply=w68, ERROR_OUT=w39)
        $"Command reply" <- w68
        w40 = s3
        w41 = default
      }
      frame "Set Time" {
        call "Enqueue Message (Single).gvi"(message queue in=w35, message="Wait For Event", error in=w38) -> (error out=w69)
        Property Node(instance in=s4) -> ("VISA Resource"=w70, instance out=w42)
        call "Read_Write_VISA.gvi"(VISA_IN=w70, CMD="@TIME 10 CEPHEI#", ERROR_IN=w69) -> (Arduino_Reply=w71, ERROR_OUT=w39)
        $"CMD TIME" <- w71
        w40 = s3
        w41 = default
      }
      frame "Watchdog" {
        Property Node(instance in=s4) -> ("Physical Channel"=w72, "VISA Resource"=w73, instance out=w42)
        call "Read_Write_VISA.gvi"(VISA_IN=w73, CMD="@TIME 10 ?#", ERROR_IN=w38) -> (OUTPUT=w74, Arduino_Reply=w75, ERROR_OUT=w76)
        call "Read_Write_VISA.gvi"(VISA_IN=w74, CMD="@LUX 10 1#", ERROR_IN=w76) -> (OUTPUT=w77, Arduino_Reply=w78, ERROR_OUT=w79)
        call "Read_Write_VISA.gvi"(VISA_IN=w77, CMD="@TEMP 12 0#", ERROR_IN=w79) -> (Arduino_Reply=w80, ERROR_OUT=w81)
        call "DAQmx Read (Analog 2D DBL NChan NSamp).gvi"(task in=w72, error in=w81, number of samples per channel=1) -> (error out=w82, data=w83)
        Array Index(array=w83) -> (out0[1, 0]=w84, out1[2, 0]=w85)
        Multiply(w84, 4) -> w86
        Multiply(w86, $"Voltage coeff") -> w87
        Feedback Node(input=w88) -> w89
        Build Array(w89, w87) -> w88
        $Voltage_Graph <- w88
        $"Recalculated Voltage" <- w87
        $"Voltage MidPoint" <- w85
        Array Index(array=w83) -> (out0[0, 0]=w90, out1[3, 0]=w91)
        Divide(x=w90, y=70) -> w92
        Multiply(w92, 1000) -> w93
        Multiply(w93, $"Current coeff") -> w94
        Feedback Node(input=w95) -> w96
        Build Array(w96, w94) -> w95
        $Current_Graph <- w95
        $"Recalculated Current" <- w94
        $"Current MidPoint" <- w91
        call "DAQmx Read (Analog 1D Wfm NChan NSamp).gvi"(task in=w72, error in=w82, number of samples per channel=1) -> (error out=w97, data=w98)
        call "Enqueue Message (Single).gvi"(message queue in=w35, message="Wait For Event", error in=w97) -> (error out=w39)
        $"AI measurements" <- w98
        Property Node(instance in=w80) -> ("DATA"=w99, instance out=w100)
        $"Reply TEMP" <- w100
        $"TempSensor Reply" <- w99
        Property Node(instance in=w78) -> ("DATA"=w101, instance out=w102)
        $"Reply LUX" <- w102
        Floating Point String To Number(string=w99) -> (number=w103)
        $TempSensor <- w103
        $"LuxSensor Reply" <- w101
        Property Node(instance in=w75) -> ("DATA"=w104, instance out=w105)
        $"Reply Arduino Status" <- w105
        Floating Point String To Number(string=w101) -> (number=w106)
        $LuxSensor <- w106
        $"Arduino Status" <- w104
        Build Array(w87, w94, w103, w106) -> w107
        $MeasuredData <- w107
        w40 = s3
        w41 = default
      }
      frame "PV Config" {
        Variant To Data(error in (no error)=w38, type=string "", variant=w37) -> (data=w108, error out=w109)
        Property Node(instance in=s4) -> ("VISA Resource"=w110, instance out=w42)
        call "PV_switch.gvi"(VISA_IN=w110, CTRL="Disconnect", ERROR_IN=w109) -> (VISA_OUT=w111, ERROR_OUT=w112)
        case (w108) {
          frame "Single" {
            w116 = ["@DO 17 0#", "@DO 18 1#", "@DO 23 1#", "@DO 24 1#", "@DO 25 1#", "@DO 26 0#", "@DO 27 0#", "@DO 28 0#", "@DO 29 1#", "@DO 30 1#", "@DO 31 1#", "@DO 32 1#", "@DO 33 0#"]
            w117 = ["@DO 54 1#", "@DO 55 1#", "@DO 56 1#", "@DO 57 1#", "@DO 58 1#", "@DO 59 1#", "@DO 60 1#", "@DO 61 1#"]
            # @DO 17 0#
            # @DO 18 1#
            # @DO 23 1#
            # @DO 24 1#
            # @DO 25 1#
            # @DO 26 0#
            # @DO 27 0#
            # @DO 28 0#
            # @DO 29 1#
            # @DO 30 1#
            # @DO 31 1#
            # @DO 32 1#
            # @DO 33 0#
            #
            # 03,08,2020
            # 19:51
            Insert Into Array(inArray=w116, new=w117) -> w118
            call "CMD_Iteration.gvi"(VISA_IN=w111, ARRAY_IN=w118, ERROR_IN=w112) -> (VISA Answer=w114, ERROR_OUT=w113)
            w115 = w108
          }
          frame "Parallel 2" {
            # @DO 17 1#
            # @DO 18 0#
            # @DO 23 1#
            # @DO 24 0#
            # @DO 25 1#
            # @DO 26 1#
            # @DO 27 1#
            # @DO 28 1#
            # @DO 29 1#
            # @DO 30 1#
            # @DO 31 1#
            # @DO 32 1#
            # @DO 33 1#
            #
            # 03.08.2020
            # 19.53
            w119 = ["@DO 17 1#", "@DO 18 0#", "@DO 23 1#", "@DO 24 0#", "@DO 25 1#", "@DO 26 1#", "@DO 27 1#", "@DO 28 1#", "@DO 29 1#", "@DO 30 1#", "@DO 31 1#", "@DO 32 1#", "@DO 33 1#"]
            # Disconnect all Diodes
            w120 = ["@DO 54 1#", "@DO 55 1#", "@DO 56 1#", "@DO 57 1#", "@DO 58 1#", "@DO 59 1#", "@DO 60 1#", "@DO 61 1#"]
            Insert Into Array(inArray=w119, new=w120) -> w121
            call "CMD_Iteration.gvi"(VISA_IN=w111, ARRAY_IN=w121, ERROR_IN=w112) -> (VISA Answer=w114, ERROR_OUT=w113)
            w115 = w108
          }
          frame "Parallel 2 Diode" {
            # @DO 17 1#
            # @DO 18 0#
            # @DO 23 1#
            # @DO 24 0#
            # @DO 25 1#
            # @DO 26 1#
            # @DO 27 1#
            # @DO 28 1#
            # @DO 29 1#
            # @DO 30 1#
            # @DO 31 1#
            # @DO 32 1#
            # @DO 33 1#
            #
            # 03.08.2020
            # 19.54
            w122 = ["@DO 17 1#", "@DO 18 0#", "@DO 23 1#", "@DO 24 0#", "@DO 25 1#", "@DO 26 1#", "@DO 27 1#", "@DO 28 1#", "@DO 29 1#", "@DO 30 1#", "@DO 31 1#", "@DO 32 1#", "@DO 33 1#"]
            # @DO 56 0#
            # @DO 57 0#
            #
            # 19.54
            w123 = ["@DO 54 1#", "@DO 55 1#", "@DO 56 0#", "@DO 57 0#", "@DO 58 1#", "@DO 59 1#", "@DO 60 1#", "@DO 61 1#"]
            Insert Into Array(inArray=w122, new=w123) -> w124
            call "CMD_Iteration.gvi"(VISA_IN=w111, ARRAY_IN=w124, ERROR_IN=w112) -> (VISA Answer=w114, ERROR_OUT=w113)
            w115 = w108
          }
          frame "Series 2" {
            # @DO 17 0#
            # @DO 18 1#
            # @DO 23 1#
            # @DO 24 0#
            # @DO 25 1#
            # @DO 26 1#
            # @DO 27 1#
            # @DO 28 1#
            # @DO 29 0#
            # @DO 30 1#
            # @DO 31 1#
            # @DO 32 0#
            # @DO 33 0#
            #
            # 03.08.2020
            # 19.55
            w125 = ["@DO 17 0#", "@DO 18 1#", "@DO 23 1#", "@DO 24 0#", "@DO 25 1#", "@DO 26 1#", "@DO 27 1#", "@DO 28 1#", "@DO 29 0#", "@DO 30 1#", "@DO 31 1#", "@DO 32 0#", "@DO 33 0#"]
            w126 = ["@DO 54 1#", "@DO 55 1#", "@DO 56 1#", "@DO 57 1#", "@DO 58 1#", "@DO 59 1#", "@DO 60 1#", "@DO 61 1#"]
            Insert Into Array(inArray=w125, new=w126) -> w127
            call "CMD_Iteration.gvi"(VISA_IN=w111, ARRAY_IN=w127, ERROR_IN=w112) -> (VISA Answer=w114, ERROR_OUT=w113)
            w115 = w108
          }
          frame "Series 2 Diode" {
            # @DO 17 0#
            # @DO 18 1#
            # @DO 23 1#
            # @DO 24 0#
            # @DO 25 1#
            # @DO 26 1#
            # @DO 27 1#
            # @DO 28 1#
            # @DO 29 0#
            # @DO 30 1#
            # @DO 31 1#
            # @DO 32 0#
            # @DO 33 0#
            #
            # 03.08.2020
            # 19.57
            w128 = ["@DO 17 0#", "@DO 18 1#", "@DO 23 1#", "@DO 24 0#", "@DO 25 1#", "@DO 26 1#", "@DO 27 1#", "@DO 28 1#", "@DO 29 0#", "@DO 30 1#", "@DO 31 1#", "@DO 32 0#", "@DO 33 0#"]
            # @DO 60 0#
            # @DO 61 0#
            #
            # 03.08.2020
            w129 = ["@DO 54 1#", "@DO 55 1#", "@DO 56 1#", "@DO 57 1#", "@DO 58 1#", "@DO 59 1#", "@DO 60 0#", "@DO 61 0#"]
            Insert Into Array(inArray=w128, new=w129) -> w130
            call "CMD_Iteration.gvi"(VISA_IN=w111, ARRAY_IN=w130, ERROR_IN=w112) -> (VISA Answer=w114, ERROR_OUT=w113)
            w115 = w108
          }
          frame "Parallel 4", Default {
            # @DO 17 1#
            # @DO 18 1#
            # @DO 23 1#
            # @DO 24 1#
            # @DO 25 1#
            # @DO 26 1#
            # @DO 27 1#
            # @DO 28 1#
            # @DO 29 1#
            # @DO 30 1#
            # @DO 31 1#
            # @DO 32 1#
            # @DO 33 1#
            #
            # 03.08.2020
            # 19.59
            w131 = ["@DO 17 1#", "@DO 18 1#", "@DO 23 1#", "@DO 24 1#", "@DO 25 1#", "@DO 26 1#", "@DO 27 1#", "@DO 28 1#", "@DO 29 1#", "@DO 30 1#", "@DO 31 1#", "@DO 32 1#", "@DO 33 1#"]
            w132 = ["@DO 54 1#", "@DO 55 1#", "@DO 56 1#", "@DO 57 1#", "@DO 58 1#", "@DO 59 1#", "@DO 60 1#", "@DO 61 1#"]
            Insert Into Array(inArray=w131, new=w132) -> w133
            call "CMD_Iteration.gvi"(VISA_IN=w111, ARRAY_IN=w133, ERROR_IN=w112) -> (VISA Answer=w114, ERROR_OUT=w113)
            w115 = w108
          }
          frame "Parallel 4 Diode" {
            # @DO 17 1#
            # @DO 18 1#
            # @DO 23 1#
            # @DO 24 1#
            # @DO 25 1#
            # @DO 26 1#
            # @DO 27 1#
            # @DO 28 1#
            # @DO 29 1#
            # @DO 30 1#
            # @DO 31 1#
            # @DO 32 1#
            # @DO 33 1#
            # 03.08.2020
            # 20.00
            w134 = ["@DO 17 1#", "@DO 18 1#", "@DO 23 1#", "@DO 24 1#", "@DO 25 1#", "@DO 26 1#", "@DO 27 1#", "@DO 28 1#", "@DO 29 1#", "@DO 30 1#", "@DO 31 1#", "@DO 32 1#", "@DO 33 1#"]
            # @DO 54 0#
            # @DO 55 0#
            # @DO 56 0#
            # @DO 57 0#
            #
            # 03.08.2020
            # 20.00
            w135 = ["@DO 54 0#", "@DO 55 0#", "@DO 56 0#", "@DO 57 0#", "@DO 58 1#", "@DO 59 1#", "@DO 60 1#", "@DO 61 1#"]
            Insert Into Array(inArray=w134, new=w135) -> w136
            call "CMD_Iteration.gvi"(VISA_IN=w111, ARRAY_IN=w136, ERROR_IN=w112) -> (VISA Answer=w114, ERROR_OUT=w113)
            w115 = w108
          }
          frame "Series 4" {
            # @DO 17 0#
            # @DO 18 1#
            # @DO 23 0#
            # @DO 24 1#
            # @DO 25 1#
            # @DO 26 0#
            # @DO 27 0#
            # @DO 28 0#
            # @DO 29 0#
            # @DO 30 0#
            # @DO 31 0#
            # @DO 32 0#
            # @DO 33 0#
            #
            # 03.08.2020
            # 20.02
            w137 = ["@DO 17 0#", "@DO 18 1#", "@DO 23 0#", "@DO 24 1#", "@DO 25 1#", "@DO 26 0#", "@DO 27 0#", "@DO 28 0#", "@DO 29 0#", "@DO 30 0#", "@DO 31 0#", "@DO 32 0#", "@DO 33 0#"]
            w138 = ["@DO 54 1#", "@DO 55 1#", "@DO 56 1#", "@DO 57 1#", "@DO 58 1#", "@DO 59 1#", "@DO 60 1#", "@DO 61 1#"]
            Insert Into Array(inArray=w137, new=w138) -> w139
            call "CMD_Iteration.gvi"(VISA_IN=w111, ARRAY_IN=w139, ERROR_IN=w112) -> (VISA Answer=w114, ERROR_OUT=w113)
            w115 = w108
          }
          frame "Series 4 Diode" {
            # @DO 17 0#
            # @DO 18 1#
            # @DO 23 0#
            # @DO 24 1#
            # @DO 25 1#
            # @DO 26 0#
            # @DO 27 0#
            # @DO 28 0#
            # @DO 29 0#
            # @DO 30 0#
            # @DO 31 0#
            # @DO 32 0#
            # @DO 33 0#
            #
            # 03.08.2020
            # 20.03
            w140 = ["@DO 17 0#", "@DO 18 1#", "@DO 23 0#", "@DO 24 1#", "@DO 25 1#", "@DO 26 0#", "@DO 27 0#", "@DO 28 0#", "@DO 29 0#", "@DO 30 0#", "@DO 31 0#", "@DO 32 0#", "@DO 33 0#"]
            # @DO 58 0#
            # @DO 59 0#
            # @DO 60 0#
            # @DO 61 0#
            #
            # 03.08.2020
            # 20.04
            w141 = ["@DO 54 1#", "@DO 55 1#", "@DO 56 1#", "@DO 57 1#", "@DO 58 0#", "@DO 59 0#", "@DO 60 0#", "@DO 61 0#"]
            Insert Into Array(inArray=w140, new=w141) -> w142
            call "CMD_Iteration.gvi"(VISA_IN=w111, ARRAY_IN=w142, ERROR_IN=w112) -> (VISA Answer=w114, ERROR_OUT=w113)
            w115 = w108
          }
          frame "Parallel Of Series" {
            # @DO 17 1#
            # @DO 18 1#
            # @DO 23 1#
            # @DO 24 1#
            # @DO 25 1#
            # @DO 26 1#
            # @DO 27 0#
            # @DO 28 1#
            # @DO 29 0#
            # @DO 30 0#
            # @DO 31 1#
            # @DO 32 0#
            # @DO 33 1#
            #
            # 03.08.2020
            # 20.05
            w143 = ["@DO 17 1#", "@DO 18 1#", "@DO 23 1#", "@DO 24 1#", "@DO 25 1#", "@DO 26 1#", "@DO 27 0#", "@DO 28 1#", "@DO 29 0#", "@DO 30 0#", "@DO 31 1#", "@DO 32 0#", "@DO 33 1#"]
            w144 = ["@DO 54 1#", "@DO 55 1#", "@DO 56 1#", "@DO 57 1#", "@DO 58 1#", "@DO 59 1#", "@DO 60 1#", "@DO 61 1#"]
            Insert Into Array(inArray=w143, new=w144) -> w145
            call "CMD_Iteration.gvi"(VISA_IN=w111, ARRAY_IN=w145, ERROR_IN=w112) -> (VISA Answer=w114, ERROR_OUT=w113)
            w115 = w108
          }
          frame "Parallel Of Series Diode" {
            # @DO 17 1#
            # @DO 18 1#
            # @DO 23 1#
            # @DO 24 1#
            # @DO 25 1#
            # @DO 26 1#
            # @DO 27 0#
            # @DO 28 1#
            # @DO 29 0#
            # @DO 30 0#
            # @DO 31 1#
            # @DO 32 0#
            # @DO 33 1#
            #
            # 03.08.2020
            # 20.06
            # @DO 58 0#
            # @DO 59 0#
            # @DO 60 0#
            # @DO 61 0#
            #
            # 03.08.2020
            # 20.097
            w146 = ["@DO 17 1#", "@DO 18 1#", "@DO 23 1#", "@DO 24 1#", "@DO 25 1#", "@DO 26 1#", "@DO 27 0#", "@DO 28 1#", "@DO 29 0#", "@DO 30 0#", "@DO 31 1#", "@DO 32 0#", "@DO 33 1#"]
            w147 = ["@DO 54 1#", "@DO 55 1#", "@DO 56 1#", "@DO 57 1#", "@DO 58 0#", "@DO 59 0#", "@DO 60 0#", "@DO 61 0#"]
            Insert Into Array(inArray=w146, new=w147) -> w148
            call "CMD_Iteration.gvi"(VISA_IN=w111, ARRAY_IN=w148, ERROR_IN=w112) -> (VISA Answer=w114, ERROR_OUT=w113)
            w115 = w108
          }
          frame "Series Of Parallel" {
            w149 = ["@DO 54 1#", "@DO 55 1#", "@DO 56 1#", "@DO 57 1#", "@DO 58 1#", "@DO 59 1#", "@DO 60 1#", "@DO 61 1#"]
            # @DO 17 1#
            # @DO 18 0#
            # @DO 23 0#
            # @DO 24 0#
            # @DO 25 0#
            # @DO 26 1#
            # @DO 27 1#
            # @DO 28 1#
            # @DO 29 1#
            # @DO 30 1#
            # @DO 31 1#
            # @DO 32 1#
            # @DO 33 1#
            #
            # 03.08.2020
            # 20.07
            w150 = ["@DO 17 1#", "@DO 18 0#", "@DO 23 0#", "@DO 24 0#", "@DO 25 0#", "@DO 26 1#", "@DO 27 1#", "@DO 28 1#", "@DO 29 1#", "@DO 30 1#", "@DO 31 1#", "@DO 32 1#", "@DO 33 1#"]
            Insert Into Array(inArray=w150, new=w149) -> w151
            call "CMD_Iteration.gvi"(VISA_IN=w111, ARRAY_IN=w151, ERROR_IN=w112) -> (VISA Answer=w114, ERROR_OUT=w113)
            w115 = w108
          }
          frame "Series Of Parallel Diode" {
            # @DO 17 1#
            # @DO 18 0#
            # @DO 23 0#
            # @DO 24 0#
            # @DO 25 0#
            # @DO 26 1#
            # @DO 27 1#
            # @DO 28 1#
            # @DO 29 1#
            # @DO 30 1#
            # @DO 31 1#
            # @DO 32 1#
            # @DO 33 1#
            #
            # 03.08.2020
            # 20.08
            w152 = ["@DO 17 1#", "@DO 18 0#", "@DO 23 0#", "@DO 24 0#", "@DO 25 0#", "@DO 26 1#", "@DO 27 1#", "@DO 28 1#", "@DO 29 1#", "@DO 30 1#", "@DO 31 1#", "@DO 32 1#", "@DO 33 1#"]
            # @DO 54 0#
            # @DO 55 0#
            # @DO 56 0#
            # @DO 57 0#
            #
            # 20.09
            # 03.08.2020
            w153 = ["@DO 54 0#", "@DO 55 0#", "@DO 56 0#", "@DO 57 0#", "@DO 58 1#", "@DO 59 1#", "@DO 60 1#", "@DO 61 1#"]
            Insert Into Array(inArray=w152, new=w153) -> w154
            call "CMD_Iteration.gvi"(VISA_IN=w111, ARRAY_IN=w154, ERROR_IN=w112) -> (VISA Answer=w114, ERROR_OUT=w113)
            w115 = w108
          }
        }
        call "PV_switch.gvi"(VISA_IN=w110, CTRL="Connect", ERROR_IN=w113) -> (ERROR_OUT=w39)
        case (w39) {
          frame Error, Default { }
          frame No Error {
            $"Status PV Config" <- w115
            Property Node(instance in=reference to "PV-Panel Cofiguration", "ValueSignaling"=w115)
          }
        }
        $"VISA Answer" <- w114
        w40 = s3
        w41 = default
      }
      frame "Prepare CVM" {
        Property Node(instance in=s4) -> ("VISA Resource"=w155, "Physical Channel"=w156, instance out=w42)
        call "DAQmx Read (Analog 2D DBL NChan NSamp).gvi"(task in=w156, error in=w38, number of samples per channel=1) -> (error out=w157, data=w158)
        Array Index(array=w158) -> (out0[2, 0]=w159)
        Multiply(w159, 4) -> w160
        C Code Node("x"=w160, Error In=w157) -> ("y"=w161, Error Out=w162)
        ~~~
        if(x>-1 && x<=1)
          y = 0;
        if(x>1 && x<=10)
          y = 1;
        if(x>10 && x<=20)
          y = 2;
        if(x>20 && x<=30)
          y = 3;
        ~~~
        Array Index(array=w158) -> (out0[3, 0]=w163)
        # Tip For Local Wiring Solution
        # Relay 1(50) 	DO 1- REP A x1
        # 		DO 0- AMP A x10
        #
        # Relay 2(51) 	DO 1-REP V x1
        # 		DO 0-DIV V x0.25
        # Relay 3(52) 	DO 1-REP V x1
        # 		DO 0-DIV V x0.5
        # Relay 4(53) 	DO 1-REP V x1
        # 		DO 0-AMP V x10
        C Code Node("x"=w163, Error In=w162) -> ("y"=w164, Error Out=w165)
        ~~~
        if(x>-1 && x<=0.6)
          y = 0;
        if(x>0.6 && x<=6)
          y = 1;
        ~~~
        # Voltage Range
        case (w161) {
          frame 0, Default {
            call "CMD_Iteration.gvi"(VISA_IN=w155, ARRAY_IN=["@DO 51 1#", "@DO 52 1#", "@DO 53 0#"], ERROR_IN=w165) -> (VISA Answer=w168, ERROR_OUT=w166)
            w167 = 0.1
          }
          frame 1 {
            call "CMD_Iteration.gvi"(VISA_IN=w155, ARRAY_IN=["@DO 51 1#", "@DO 52 1#", "@DO 53 1#"], ERROR_IN=w165) -> (VISA Answer=w168, ERROR_OUT=w166)
            w167 = 1
          }
          frame 2 {
            call "CMD_Iteration.gvi"(VISA_IN=w155, ARRAY_IN=["@DO 51 1#", "@DO 52 0#", "@DO 53 1#"], ERROR_IN=w165) -> (VISA Answer=w168, ERROR_OUT=w166)
            w167 = 0.5
          }
          frame 3 {
            # Div x0.25 works with 2 relay
            call "CMD_Iteration.gvi"(VISA_IN=w155, ARRAY_IN=["@DO 51 0#\n"], ERROR_IN=w165) -> (VISA Answer=w168, ERROR_OUT=w166)
            w167 = 0.25
          }
        }
        $"Voltage coeff" <- w167
        $"VISA Answer_2" <- w168
        # Current Range
        case (w164) {
          frame 0, Default {
            call "CMD_Iteration.gvi"(VISA_IN=w155, ARRAY_IN=["@DO 50 0#"], ERROR_IN=w166) -> (ERROR_OUT=w39)
            w169 = 0.1
          }
          frame 1 {
            call "CMD_Iteration.gvi"(VISA_IN=w155, ARRAY_IN=["@DO 50 1#"], ERROR_IN=w166) -> (ERROR_OUT=w39)
            w169 = 1
          }
        }
        $"Current coeff" <- w169
        w40 = s3
        w41 = default
      }
      frame "Reset CVM" {
        Property Node(instance in=s4) -> ("VISA Resource"=w170, instance out=w42)
        # VOLTAGE RANGE
        # @DO 51 0#
        # @DO 52 0#
        # @DO 53 0#
        # CURRENT RANGE
        # @DO 50 1#
        call "CMD_Iteration.gvi"(VISA_IN=w170, ARRAY_IN=["@DO 51 1#", "@DO 52 1#", "@DO 53 1#"], ERROR_IN=w38) -> (VISA_OUT=w171, ERROR_OUT=w172)
        call "CMD_Iteration.gvi"(VISA_IN=w171, ARRAY_IN=["@DO 50 1#"], ERROR_IN=w172) -> (ERROR_OUT=w39)
        $"Voltage coeff" <- 1
        $"Current coeff" <- 1
        w40 = s3
        w41 = default
      }
      frame "VAC" {
        w173 = ["0", "1,", "10,", "20,10,", "50,", "50,20,", "100,", "100,40,10,", "200,100,", "500,100,", "1000,", "2000,", "2000,1000,", "4000,", "4000,1000,", "4000,2000,", "4000,2000,1000,", "4000,2000,1000,500,400,100,"]
        Array Size(array=w173) -> (size(s)=w174)
        Is Less Or Equal(x=$"VAC Load Counter", y=w174) -> w175
        Property Node(instance in=s4) -> ("VISA Resource"=w176, "Physical Channel"=w177, instance out=w42)
        Variant To Data(type=timestamp 1904-01-01T00:00:00Z, variant=w37) -> (data=w178)
        Get Current Time() -> (current time=w179)
        Timestamp Subtract(x=w179, y=w178) -> w180
        Is Greater Or Equal(x=w180, y=5) -> w181
        Logical And(w181, w175) -> w182
        call "DAQmx Read (Analog 2D DBL NChan NSamp).gvi"(task in=w177, number of samples per channel=1) -> (data=w183)
        Array Index(array=w183) -> (out0[1, 0]=w184)
        Multiply(w184, 4) -> w185
        Feedback Node(input=w186) -> w187
        Build Array(w187, w185) -> w186
        Array Index(array=w183) -> (out0[0, 0]=w188)
        Divide(x=w188, y=70) -> w189
        Multiply(w189, 1000) -> w190
        Feedback Node(input=w191) -> w192
        Build Array(w192, w190) -> w191
        Build Cluster(w186, w191) -> w193
        case (w182) {
          frame False, Default {
            w194 = w38
            w195 = w178
            w196 = $"VAC Load Counter"
          }
          frame True {
            Get Current Time() -> (current time=w195)
            # Disconnect ALL load
            Array Index(array=w173) -> (out0[$"VAC Load Counter"]=w197)
            w198 = ["@DO 42 1#", "@DO 34 0#", "@DO 35 0#", "@DO 36 0#", "@DO 37 0#", "@DO 38 0#", "@DO 39 0#", "@DO 40 0#", "@DO 41 0#", "@DO 43 0#", "@DO 44 0#", "@DO 45 0#", "@DO 46 0#", "@DO 47 0#", "@DO 48 0#", "@DO 49 0#"]
            call "CMD_Iteration.gvi"(VISA_IN=w176, ARRAY_IN=w198, ERROR_IN=w38) -> (ERROR_OUT=w199)
            s5 = w197  # shift register
            while {
              Match Pattern(regular expression=",", string=s5) -> (after substring=w200, before substring=w201)
              case (w201) {
                frame "1", Default {
                  call "Read_Write_VISA.gvi"(VISA_IN=w176, CMD="@DO 43 1#", ERROR_IN=w199) -> (ERROR_OUT=w202)
                }
                frame "2" {
                  call "Read_Write_VISA.gvi"(VISA_IN=w176, CMD="@DO 44 1#", ERROR_IN=w199) -> (ERROR_OUT=w202)
                }
                frame "3" {
                  call "Read_Write_VISA.gvi"(VISA_IN=w176, CMD="@DO 45 1#", ERROR_IN=w199) -> (ERROR_OUT=w202)
                }
                frame "5" {
                  call "Read_Write_VISA.gvi"(VISA_IN=w176, CMD="@DO 46 1#", ERROR_IN=w199) -> (ERROR_OUT=w202)
                }
                frame "10" {
                  call "Read_Write_VISA.gvi"(VISA_IN=w176, CMD="@DO 47 1#", ERROR_IN=w199) -> (ERROR_OUT=w202)
                }
                frame "20" {
                  call "Read_Write_VISA.gvi"(VISA_IN=w176, CMD="@DO 48 1#", ERROR_IN=w199) -> (ERROR_OUT=w202)
                }
                frame "40" {
                  call "Read_Write_VISA.gvi"(VISA_IN=w176, CMD="@DO 49 1#", ERROR_IN=w199) -> (ERROR_OUT=w202)
                }
                frame "50" {
                  call "Read_Write_VISA.gvi"(VISA_IN=w176, CMD="@DO 34 1#", ERROR_IN=w199) -> (ERROR_OUT=w202)
                }
                frame "100" {
                  call "Read_Write_VISA.gvi"(VISA_IN=w176, CMD="@DO 35 1#", ERROR_IN=w199) -> (ERROR_OUT=w202)
                }
                frame "200" {
                  call "Read_Write_VISA.gvi"(VISA_IN=w176, CMD="@DO 36 1#", ERROR_IN=w199) -> (ERROR_OUT=w202)
                }
                frame "400" {
                  call "Read_Write_VISA.gvi"(VISA_IN=w176, CMD="@DO 37 1#", ERROR_IN=w199) -> (ERROR_OUT=w202)
                }
                frame "500" {
                  call "Read_Write_VISA.gvi"(VISA_IN=w176, CMD="@DO 38 1#", ERROR_IN=w199) -> (ERROR_OUT=w202)
                }
                frame "1000" {
                  call "Read_Write_VISA.gvi"(VISA_IN=w176, CMD="@DO 39 1#", ERROR_IN=w199) -> (ERROR_OUT=w202)
                }
                frame "2000" {
                  call "Read_Write_VISA.gvi"(VISA_IN=w176, CMD="@DO 40 1#", ERROR_IN=w199) -> (ERROR_OUT=w202)
                }
                frame "4000" {
                  call "Read_Write_VISA.gvi"(VISA_IN=w176, CMD="@DO 41 1#", ERROR_IN=w199) -> (ERROR_OUT=w202)
                }
                frame "0" {
                  # Для измерения тока К.З.
                  # Схема сопротивления
                  # 1 Ом + 1 Ом токовый резистор
                  w202 = w199
                }
              }
              Is Empty String Or Path(string/path=w200) -> w203
              next s5 = w200
              stop if w203
            }
            call "Read_Write_VISA.gvi"(VISA_IN=w176, CMD="@DO 42 0#", ERROR_IN=w202) -> (ERROR_OUT=w194)
            Increment(x=$"VAC Load Counter") -> w196
            $VAC <- w193
          }
        }
        call "Enqueue Message (Single).gvi"(message queue in=w35, message="Watchdog", error in=w194) -> (error out=w204)
        case (w175) {
          frame False, Default {
            w39 = w204
          }
          frame True {
            call "Enqueue Message (Single).gvi"(message queue in=w35, message="VAC", message data=w195, error in=w204) -> (error out=w39)
          }
        }
        $"VAC Load Counter" <- w196
        w40 = s3
        w41 = default
      }
      frame "Optic Filter Config" {
        Property Node(instance in=s4) -> ("VISA Resource"=w205, instance out=w42)
        Variant To Data(error in (no error)=w38, type=string "", variant=w37) -> (data=w206, error out=w207)
        case (w206) {
          frame "None", Default {
            w208 = ["@SERV 3 90#", "@SERV 4 0#"]
          }
          frame "Filter 1" {
            w208 = ["@SERV 3 90#", "@SERV 4 0#", "@SERV 3 0#"]
          }
          frame "Filter 2" {
            w208 = ["@SERV 3 90#", "@SERV 4 0#", "@SERV 4 90#"]
          }
        }
        call "CMD_Iteration.gvi"(VISA_IN=w205, ARRAY_IN=w208, ERROR_IN=w207) -> (ERROR_OUT=w39)
        w40 = s3
        w41 = default
      }
      frame "Fans Control" {
        Property Node(instance in=s4) -> ("VISA Resource"=w209, instance out=w42)
        Variant To Data(error in (no error)=w38, type=string "", variant=w37) -> (data=w210, error out=w211)
        case (w210) {
          frame "Turn All Off", Default {
            w212 = ["@DO 7 0#", "@DO 8 0#"]
          }
          frame "Turn All On" {
            w212 = ["@DO 7 1#", "@DO 8 1#"]
          }
          frame "Turn 1,2 On" {
            w212 = ["@DO 7 1#", "@DO 8 0#", ""]
          }
          frame "Turn 3,4 On" {
            w212 = ["@DO 8 1#", "@DO 7 0#"]
          }
        }
        call "CMD_Iteration.gvi"(VISA_IN=w209, ARRAY_IN=w212, ERROR_IN=w211) -> (ERROR_OUT=w39)
        w40 = s3
        w41 = default
      }
      frame "Heat Config" {
        Property Node(instance in=s4) -> ("VISA Resource"=w213, instance out=w42)
        Variant To Data(error in (no error)=w38, type=string "", variant=w37) -> (data=w214, error out=w215)
        case (w214) {
          frame "No Heat", Default {
            w216 = ["@PWM 9 0#"]
          }
          frame "50 Heat" {
            w216 = ["@PWM 9 125#"]
          }
          frame "100 Heat" {
            w216 = ["@PWM 9 255#"]
          }
        }
        call "CMD_Iteration.gvi"(VISA_IN=w213, ARRAY_IN=w216, ERROR_IN=w215) -> (ERROR_OUT=w39)
        w40 = s3
        w41 = default
      }
      frame "Set PV Angle" {
        Property Node(instance in=s4) -> ("VISA Resource"=w217, instance out=w42)
        Variant To Data(error in (no error)=w38, type=u32 0, variant=w37) -> (data=w218, error out=w219)
        # Set angle limits for PV panels
        In Range And Coerce(lower limit=0, upper limit=180, x=w218) -> (coerced(x)=w220)
        Number To Decimal String(number=w220) -> (decimal integer string=w221)
        Concatenate Strings("@SERV 13 ", w221, " #") -> w222
        call "Read_Write_VISA.gvi"(VISA_IN=w217, CMD=w222, ERROR_IN=w219) -> (ERROR_OUT=w39)
        w40 = s3
        w41 = default
      }
      frame "Brightness Config" {
        Property Node(instance in=s4) -> ("VISA Resource"=w223, instance out=w42)
        Variant To Data(error in (no error)=w38, type=u32 0, variant=w37) -> (data=w224, error out=w225)
        # Set brightness limits
        In Range And Coerce(lower limit=0, upper limit=100, x=w224) -> (coerced(x)=w226)
        Number To Decimal String(number=w226) -> (decimal integer string=w227)
        Concatenate Strings("@DIM 6 ", w227, " #") -> w228
        call "Read_Write_VISA.gvi"(VISA_IN=w223, CMD=w228, ERROR_IN=w225) -> (ERROR_OUT=w39)
        w40 = s3
        w41 = default
      }
      frame "IR Thermometer" {
        Property Node(instance in=s4) -> ("VISA Resource"=w229, instance out=w42)
        Variant To Data(error in (no error)=w38, type=string "", variant=w37) -> (data=w230, error out=w231)
        case (w230) {
          frame "None", Default {
            w232 = "@SERV 5 0#"
          }
          frame "Panel 1" {
            w232 = "@SERV 5 50#"
          }
          frame "Panel 2" {
            w232 = "@SERV 5 90#"
          }
          frame "Panel 3" {
            w232 = "@SERV 5 120#"
          }
          frame "Panel 4" {
            w232 = "@SERV 5 150#"
          }
        }
        call "Read_Write_VISA.gvi"(VISA_IN=w229, CMD=w232, ERROR_IN=w231) -> (ERROR_OUT=w39)
        w40 = s3
        w41 = default
      }
      frame "Set Resistance" {
        Property Node(instance in=s4) -> ("VISA Resource"=w233, instance out=w42)
        Variant To Data(error in (no error)=w38, type=string "", variant=w37) -> (data=w234, error out=w235)
        # Disconnect ALL load
        w236 = ["@DO 42 1#", "@DO 34 0#", "@DO 35 0#", "@DO 36 0#", "@DO 37 0#", "@DO 38 0#", "@DO 39 0#", "@DO 40 0#", "@DO 41 0#", "@DO 43 0#", "@DO 44 0#", "@DO 45 0#", "@DO 46 0#", "@DO 47 0#", "@DO 48 0#", "@DO 49 0#"]
        call "CMD_Iteration.gvi"(VISA_IN=w233, ARRAY_IN=w236, ERROR_IN=w235) -> (VISA_OUT=w237, ERROR_OUT=w238)
        s6 = w234  # shift register
        while {
          Match Pattern(regular expression=",", string=s6) -> (after substring=w239, before substring=w240)
          case (w240) {
            frame "1", Default {
              call "Read_Write_VISA.gvi"(VISA_IN=w237, CMD="@DO 43 1#", ERROR_IN=w238) -> (ERROR_OUT=w241)
            }
            frame "2" {
              call "Read_Write_VISA.gvi"(VISA_IN=w237, CMD="@DO 44 1#", ERROR_IN=w238) -> (ERROR_OUT=w241)
            }
            frame "3" {
              call "Read_Write_VISA.gvi"(VISA_IN=w237, CMD="@DO 45 1#", ERROR_IN=w238) -> (ERROR_OUT=w241)
            }
            frame "5" {
              call "Read_Write_VISA.gvi"(VISA_IN=w237, CMD="@DO 46 1#", ERROR_IN=w238) -> (ERROR_OUT=w241)
            }
            frame "10" {
              call "Read_Write_VISA.gvi"(VISA_IN=w237, CMD="@DO 47 1#", ERROR_IN=w238) -> (ERROR_OUT=w241)
            }
            frame "20" {
              call "Read_Write_VISA.gvi"(VISA_IN=w237, CMD="@DO 48 1#", ERROR_IN=w238) -> (ERROR_OUT=w241)
            }
            frame "40" {
              call "Read_Write_VISA.gvi"(VISA_IN=w237, CMD="@DO 49 1#", ERROR_IN=w238) -> (ERROR_OUT=w241)
            }
            frame "50" {
              call "Read_Write_VISA.gvi"(VISA_IN=w237, CMD="@DO 34 1#", ERROR_IN=w238) -> (ERROR_OUT=w241)
            }
            frame "100" {
              call "Read_Write_VISA.gvi"(VISA_IN=w237, CMD="@DO 35 1#", ERROR_IN=w238) -> (ERROR_OUT=w241)
            }
            frame "200" {
              call "Read_Write_VISA.gvi"(VISA_IN=w237, CMD="@DO 36 1#", ERROR_IN=w238) -> (ERROR_OUT=w241)
            }
            frame "400" {
              call "Read_Write_VISA.gvi"(VISA_IN=w237, CMD="@DO 37 1#", ERROR_IN=w238) -> (ERROR_OUT=w241)
            }
            frame "500" {
              call "Read_Write_VISA.gvi"(VISA_IN=w237, CMD="@DO 38 1#", ERROR_IN=w238) -> (ERROR_OUT=w241)
            }
            frame "1000" {
              call "Read_Write_VISA.gvi"(VISA_IN=w237, CMD="@DO 39 1#", ERROR_IN=w238) -> (ERROR_OUT=w241)
            }
            frame "2000" {
              call "Read_Write_VISA.gvi"(VISA_IN=w237, CMD="@DO 40 1#", ERROR_IN=w238) -> (ERROR_OUT=w241)
            }
            frame "4000" {
              call "Read_Write_VISA.gvi"(VISA_IN=w237, CMD="@DO 41 1#", ERROR_IN=w238) -> (ERROR_OUT=w241)
            }
            frame "0" {
              # Для измерения тока К.З.
              # Схема сопротивления
              # 1 Ом + 1 Ом токовый резистор
              w241 = w238
            }
          }
          Is Empty String Or Path(string/path=w239) -> w242
          next s6 = w239
          stop if w242
        }
        # Connect Load
        call "Read_Write_VISA.gvi"(VISA_IN=w233, CMD="@DO 42 0#", ERROR_IN=w241) -> (ERROR_OUT=w39)
        w40 = s3
        w41 = default
      }
      frame "Reset Resistance" {
        Property Node(instance in=s4) -> ("VISA Resource"=w243, instance out=w42)
        # Размыкаются всё реле, сопротивление- бесконечность
        w244 = ["@DO 42 1#", "@DO 34 1#", "@DO 35 1#", "@DO 36 1#", "@DO 37 1#", "@DO 38 1#", "@DO 39 1#", "@DO 40 1#", "@DO 41 1#", "@DO 43 1#", "@DO 44 1#", "@DO 45 1#", "@DO 46 1#", "@DO 47 1#", "@DO 48 1#", "@DO 49 1#"]
        # Сопротивление в начальное положение
        call "CMD_Iteration.gvi"(VISA_IN=w243, ARRAY_IN=w244, ERROR_IN=w38) -> (ERROR_OUT=w39)
        w40 = s3
        w41 = default
      }
      frame "Error" {
        Variant To Data(error in (no error)=w38, type=no error, variant=w37) -> (data=w245, error out=w39)
        # #CodeRecommended - If you ever change the name of this "Error" message, you'll need to update the name in the Check Loop Error.vi as well.
        call "Display Error.gvi"(error in=w245)
        w40 = s3
        w41 = default
        w42 = s4
      }
      frame "Exit" {
        Generate User Event(event data=TRUE, user event=w25) -> (error out=w246)
        Release Queue(error in=w38, queue=w35) -> (error out=w247)
        Property Node(instance in=s4) -> ("VISA Resource"=w248, "Physical Channel"=w249)
        call "DAQmx Stop Task.gvi"(task in=w249) -> (error out=w250)
        call "Close (Instr).gvi"(session in=w248, error in=w250) -> (error out=w251)
        Merge Errors(w251, w246, w247) -> (error out=w39)
        w40 = s3
        w41 = TRUE
        w42 = default
      }
      frame Default {
        w252 = "The invalid message string \"%s\" was received in the Message Handling Loop."
        Format Into String(formatString=w252, w36) -> w253
        call "Build Error Cluster.gvi"(code=1, description=w253) -> (error out=w39)
        w40 = s3
        w41 = default
        w42 = s4
      }
    }
    call "Error Handler - Message Handling Loop.gvi"(message queue in=w35, error in=w39) -> (dup error in=w254)
    $Output <- w39
    next s3 = w40
    next s4 = w42
    stop if w41
  }
  $"Server URL" <- "https://api.systemlinkcloud.com/"
  $"Exit 2" <- FALSE
  $SendArrayDoubleToCloud <- "Send Measured Data To Cloud"
  $SendStringToCloud <- "Send String To Cloud"
  $SendDoubleToCloud <- "Send Double To Cloud"
  w255 = bool FALSE  # Stop Event
  Create User Event[EventName="Stop Event"](user event data type=w255) -> (error out=w256, user event out=w257)
  call "Create All Message Queues.gvi"(error in=w256) -> (message queues=w258, error out=w259)
  Property Node(instance in=w258) -> ("UI"=w260)
  s7 = "UI Data.gtype" {all zero or empty}  # shift register
  while {
    call "Dequeue Message.gvi"(message queue in=w260, error in=w259) -> (message queue out=w261, message=w262, message data=w263, error out=w264)
    # s7: Data
    # w257: Stop Event
    case (w262) ignore case {  # Message Cases
      frame "Initialize" {
        Property Node(instance in=s7, "String"=w262) -> (instance out=w266)
        call "Enqueue Message (Single).gvi"(message queue in=w261, message="Update Display", message data=w262, error in=w264) -> (message queue out=w268, error out=w269)
        # Bundle a sample string value.
        call "Enqueue Message (Single).gvi"(message queue in=w268, message=$SendArrayDoubleToCloud, error in=w269) -> (error out=w265)
        Property Node(instance in=reference to "MV-Panel Configuration", "ValueSignaling"="none")
        Property Node(instance in=reference to "PV-Panel Cofiguration", "ValueSignaling"="none")
        Property Node(instance in=reference to "PV-Temperature, ºC", "ValueSignaling"=0)
        Property Node(instance in=reference to "MV-Heating", "ValueSignaling"="none")
        Property Node(instance in=reference to "PV-Heating", "ValueSignaling"="none")
        Property Node(instance in=reference to "MV-Cooling", "ValueSignaling"="none")
        Property Node(instance in=reference to "PV-LightIntensity, W/m2", "ValueSignaling"=0)
        Property Node(instance in=reference to "PV-Cooling", "ValueSignaling"="none")
        Property Node(instance in=reference to "MV-Light Power", "ValueSignaling"="none")
        Property Node(instance in=reference to "PV-Panel Tilt Angle, º", "ValueSignaling"=0)
        Property Node(instance in=reference to "PV-Optical Filter", "ValueSignaling"="none")
        Property Node(instance in=reference to "MV-Optical Filter", "ValueSignaling"="none")
        Property Node(instance in=reference to "PV-LoadR4", "ValueSignaling"="none")
        Property Node(instance in=reference to "PV-Voltage, V", "ValueSignaling"=0)
        Property Node(instance in=reference to "MV-Panel Tilt Angle", "ValueSignaling"="none")
        Property Node(instance in=reference to "PV-LoadR3", "ValueSignaling"="none")
        Property Node(instance in=reference to "PV-Current, mA", "ValueSignaling"=0)
        Property Node(instance in=reference to "MV-LoadR1", "ValueSignaling"="none")
        Property Node(instance in=reference to "PV-LoadR2", "ValueSignaling"="none")
        Property Node(instance in=reference to "PV-LoadR,Ohm", "ValueSignaling"=0)
        Property Node(instance in=reference to "MV-LoadR2", "ValueSignaling"="none")
        Property Node(instance in=reference to "PV-LoadR1", "ValueSignaling"="none")
        Property Node(instance in=reference to "MV-LoadR3", "ValueSignaling"="none")
        Property Node(instance in=reference to "MV-LoadR4", "ValueSignaling"="none")
        w267 = default
      }
      frame "Something" {
        # #CodeNeeded - Perform whatever actions correspond to the "Something" message.
        # Send string to "Update Display" message
        call "Enqueue Message (Single).gvi"(message queue in=w261, message="Update Display", message data="\"Do Something\" button pressed", error in=w264) -> (error out=w265)
        w266 = s7
        w267 = default
      }
      frame "Something Else" {
        # #CodeNeeded - Perform whatever actions correspond to the "Something Else" message.
        # Send string to "Update Display" message
        call "Enqueue Message (Single).gvi"(message queue in=w261, message="Update Display", message data="\"Do Something Else\" button pressed", error in=w264) -> (error out=w265)
        w266 = s7
        w267 = default
      }
      frame "Update Display" {
        # #CodeRecommended - If you wish to decouple the Message Handling Loop from your user interface, consider creating User Events (like the "Stop" event in this VI) to message the Event Handling Loop whenever the user interface needs updating.
        Variant To Data(error in (no error)=w264, type=string "", variant=w263) -> (data=w270, error out=w265)
        $"Status of Send to SystemLink Cycle" <- w270
        w266 = s7
        w267 = default
      }
      frame "Error" {
        Variant To Data(error in (no error)=w264, type=no error, variant=w263) -> (data=w271, error out=w265)
        # #CodeRecommended - Consider creating a system for logging errors in some way. These errors are for notification purposes only. Handling of specific errors should be performed in the message frames that generated the error.
        # #CodeRecommended - If you ever change the name of this "Error" message, you'll need to update the name in the Check Loop Error.vi as well.
        call "Display Error.gvi"(error in=w271)
        w266 = s7
        w267 = default
      }
      frame "---Copy This Frame---" {
        Merge Errors(w264) -> (error out=w265)
        w266 = s7
        w267 = default
      }
      frame "Exit" {
        # Release the message queue reference
        Release Queue(error in=w264, queue=w261) -> (error out=w272)
        # #CodeNeeded - Add any required cleanup code here. Note that if 'Exit' was called as a result of an error, an error dialog will be displayed. Add any custom error handling for an 'Exit' condition here as well.
        Generate User Event(event data=TRUE, user event=w257) -> (error out=w273)
        Merge Errors(w273, w272) -> (error out=w265)
        # Stop the VI
        $"Exit 2" <- TRUE
        w266 = s7
        w267 = TRUE
      }
      frame Default {
        w274 = "The invalid message string \"%s\" was received in the Message Handling Loop."
        Format Into String(formatString=w274, w262) -> w275
        call "Build Error Cluster.gvi"(code=1, description=w275) -> (error out=w265)
        w266 = s7
        w267 = default
      }
      frame "Send Double To Cloud" {
        Property Node(instance in=s7, "String"=w262) -> (instance out=w266)
        call "Open Configuration API Key.gvi"(server url=$"Server URL", api key=$"API Key", error in=w264) -> (configuration=w276)
        Variant To Data(type=string[] [], variant=w263) -> (data=w277)
        Array Index(array=w277) -> (out0[0]=w278, out1[1]=w279)
        Floating Point String To Number(string=w279) -> (number=w280)
        Build Array(w278) -> w281
        call "Query Tags.gvi"(paths=w281, configuration=w276) -> (tags=w282, error out=w283)
        Array Index(array=w282) -> (out0[_]=w284)
        Property Node(instance in=w284) -> ("Path"=w285, "Datatype"=w286)
        call "Open Tag.gvi"(path=w285, data type=w286, error in=w283, configuration=w276) -> (tag=w287, error out=w288)
        call "Write Tag (DBL).gvi"(tag in=w287, value=w280, error in=w288) -> (tag out=w289, error out=w290)
        call "Close Tag (Single).gvi"(tag=w289, error in=w290) -> (error out=w291)
        call "Close Configuration.gvi"(configuration=w276, error in=w291) -> (error out=w265)
        call "Enqueue Message (Single).gvi"(message queue in=w261, message="Update Display", message data=w262)
        w267 = default
      }
      frame "Send Measured Data To Cloud" {
        Property Node(instance in=s7, "String"=w262) -> (instance out=w266)
        call "Enqueue Message (Single).gvi"(message queue in=w261, message="Update Display", message data=w262, error in=w264) -> (message queue out=w292, error out=w293)
        call "Enqueue Message (Single).gvi"(message queue in=w292, message=$SendArrayDoubleToCloud, error in=w293) -> (error out=w294)
        call "Open Configuration API Key.gvi"(server url=$"Server URL", api key=$"API Key", error in=w294) -> (configuration=w295, error out=w296)
        w297 = ["PV-Current", "PV-Voltage", "PV-Temperature", "PV-LigthtIntensity"]
        call "Query Tags.gvi"(paths=w297, error in=w296, configuration=w295) -> (tags=w298, error out=w299)
        for {
          w300 = each element of w298
          w301 = each element of $MeasuredData
          Property Node(instance in=w300) -> ("Path"=w302, "Datatype"=w303)
          call "Open Tag.gvi"(path=w302, data type=w303, error in=w299, configuration=w295) -> (tag=w304, error out=w305)
          call "Write Tag (DBL).gvi"(tag in=w304, value=w301, error in=w305) -> (error out=w306)
        }
        for {
          w307 = each element of w298
          call "Close Tag (Single).gvi"(tag=w307, error in=w306) -> (error out=w308)
        }
        call "Close Configuration.gvi"(configuration=w295, error in=w308) -> (error out=w265)
        w267 = default
      }
      frame "Send String To Cloud" {
        Property Node(instance in=s7, "String"=w262) -> (instance out=w266)
        call "Open Configuration API Key.gvi"(server url=$"Server URL", api key=$"API Key", error in=w264) -> (configuration=w309, error out=w310)
        Variant To Data(type=string[] [], variant=w263) -> (data=w311)
        Array Index(array=w311) -> (out0[0]=w312, out1[1]=w313)
        Build Array(w312) -> w314
        call "Query Tags.gvi"(paths=w314, configuration=w309) -> (tags=w315)
        Array Index(array=w315) -> (out0[_]=w316)
        Property Node(instance in=w316) -> ("Path"=w317, "Datatype"=w318)
        call "Open Tag.gvi"(path=w317, data type=w318, error in=w310, configuration=w309) -> (tag=w319, error out=w320)
        call "Write Tag (String).gvi"(tag in=w319, value=w313, error in=w320) -> (tag out=w321, error out=w322)
        call "Close Tag (Single).gvi"(tag=w321, error in=w322) -> (error out=w323)
        call "Close Configuration.gvi"(configuration=w309, error in=w323) -> (error out=w265)
        call "Enqueue Message (Single).gvi"(message queue in=w261, message="Update Display", message data=w262)
        w267 = default
      }
    }
    call "Error Handler - Message Handling Loop.gvi"(message queue in=w261, error in=w265) -> (dup error in=w324)
    next s7 = w266
    stop if w267
  }
  Register For Events("Stop Event"=w257) -> (event registration refnum out=w325)
  s8 = w325  # shift register
  while {
    event (dynamic events = s8) {
      on "Do Something" Value changed {
        # #CodeNeeded - Send the appropriate message for this user interface event.
        call "Enqueue Message (Single).gvi"(message queue in=w260, message="Something") -> (message queue out=w328, error out=w327)
        w326 = default
      }
      on "Do Something Else" Value changed {
        # #CodeNeeded - Send the appropriate message for this user interface event.
        call "Enqueue Message (Single).gvi"(message queue in=w260, message="Something Else") -> (message queue out=w328, error out=w327)
        w326 = default
      }
      on "Exit" Value changed {
        call "Enqueue Message (Single).gvi"(priority message=TRUE, message queue in=w260, message="Exit") -> (message queue out=w328, error out=w327)
        w326 = default
      }
      on dynamic event 0 {
        # The Message Handling Loop processed an "Exit" message, which fired this event to stop the Event Handling Loop.
        $"Status of Send to SystemLink Cycle" <- "\"Exit\" button pressed"
        w326 = TRUE
        w327 = default
        w328 = w260
      }
      on "Window" Close? {
        call "Enqueue Message (Single).gvi"(priority message=TRUE, message queue in=w260, message="Exit") -> (message queue out=w328)
        Event Filter("Discard?"=TRUE)
        w326 = default
        w327 = default
      }
      on "PV-Current, mA" Value changed {
        Event Data() -> ("New Value"=w329)
        Number To Fractional String(number=w329) -> (F-format string=w330)
        Build Array("PV-Current", w330) -> w331
        call "Enqueue Message (Single).gvi"(message queue in=w260, message=$SendDoubleToCloud, message data=w331) -> (message queue out=w328)
        w326 = default
        w327 = default
      }
      on "PV-LoadR,Ohm" Value changed {
        Event Data() -> ("New Value"=w332)
        Number To Fractional String(number=w332) -> (F-format string=w333)
        Build Array("PV-LoadR", w333) -> w334
        call "Enqueue Message (Single).gvi"(message queue in=w260, message=$SendDoubleToCloud, message data=w334) -> (message queue out=w328)
        w326 = default
        w327 = default
      }
      on "PV-Voltage, V" Value changed {
        Event Data() -> ("New Value"=w335)
        Number To Fractional String(number=w335) -> (F-format string=w336)
        Build Array("PV-Voltage", w336) -> w337
        call "Enqueue Message (Single).gvi"(message queue in=w260, message=$SendDoubleToCloud, message data=w337) -> (message queue out=w328)
        w326 = default
        w327 = default
      }
      on "PV-Temperature, ºC" Value changed {
        Event Data() -> ("New Value"=w338)
        Number To Fractional String(number=w338) -> (F-format string=w339)
        Build Array("PV-Temperature", w339) -> w340
        call "Enqueue Message (Single).gvi"(message queue in=w260, message=$SendDoubleToCloud, message data=w340) -> (message queue out=w328)
        w326 = default
        w327 = default
      }
      on "PV-LightIntensity, W/m2" Value changed {
        Event Data() -> ("New Value"=w341)
        Number To Fractional String(number=w341) -> (F-format string=w342)
        Build Array("PV-LigthtIntensity", w342) -> w343
        call "Enqueue Message (Single).gvi"(message queue in=w260, message=$SendDoubleToCloud, message data=w343) -> (message queue out=w328)
        w326 = default
        w327 = default
      }
      on "PV-Panel Tilt Angle, º" Value changed {
        Event Data() -> ("New Value"=w344)
        Number To Fractional String(number=w344) -> (F-format string=w345)
        Build Array("PV-Panel Tilt Angle", w345) -> w346
        call "Enqueue Message (Single).gvi"(message queue in=w260, message=$SendDoubleToCloud, message data=w346) -> (message queue out=w328)
        w326 = default
        w327 = default
      }
      on "PV-Panel Cofiguration" Value changed {
        Event Data() -> ("New Value"=w347)
        Build Array("PV-Panel Configuration", w347) -> w348
        call "Enqueue Message (Single).gvi"(message queue in=w260, message=$SendStringToCloud, message data=w348) -> (message queue out=w328)
        w326 = default
        w327 = default
      }
      on "PV-Cooling" Value changed {
        Event Data() -> ("New Value"=w349)
        Build Array("PV-Cooling", w349) -> w350
        call "Enqueue Message (Single).gvi"(message queue in=w260, message=$SendStringToCloud, message data=w350) -> (message queue out=w328)
        w326 = default
        w327 = default
      }
      on "PV-Heating" Value changed {
        Event Data() -> ("New Value"=w351)
        Build Array("PV-Heating", w351) -> w352
        call "Enqueue Message (Single).gvi"(message queue in=w260, message=$SendStringToCloud, message data=w352) -> (message queue out=w328)
        w326 = default
        w327 = default
      }
      on "PV-Optical Filter" Value changed {
        Event Data() -> ("New Value"=w353)
        Build Array("PV-Optical Filter", w353) -> w354
        call "Enqueue Message (Single).gvi"(message queue in=w260, message=$SendStringToCloud, message data=w354) -> (message queue out=w328)
        w326 = default
        w327 = default
      }
      on "PV-LoadR1" Value changed {
        Event Data() -> ("New Value"=w355)
        Build Array("PV-LoadR1", w355) -> w356
        call "Enqueue Message (Single).gvi"(message queue in=w260, message=$SendStringToCloud, message data=w356) -> (message queue out=w328)
        w326 = default
        w327 = default
      }
      on "PV-LoadR2" Value changed {
        Event Data() -> ("New Value"=w357)
        Build Array("PV-LoadR2", w357) -> w358
        call "Enqueue Message (Single).gvi"(message queue in=w260, message=$SendStringToCloud, message data=w358) -> (message queue out=w328)
        w326 = default
        w327 = default
      }
      on "PV-LoadR3" Value changed {
        Event Data() -> ("New Value"=w359)
        Build Array("PV-LoadR3", w359) -> w360
        call "Enqueue Message (Single).gvi"(message queue in=w260, message=$SendStringToCloud, message data=w360) -> (message queue out=w328)
        w326 = default
        w327 = default
      }
      on "PV-LoadR4" Value changed {
        Event Data() -> ("New Value"=w361)
        Build Array("PV-LoadR4", w361) -> w362
        call "Enqueue Message (Single).gvi"(message queue in=w260, message=$SendStringToCloud, message data=w362) -> (message queue out=w328)
        w326 = default
        w327 = default
      }
    }
    call "Error Handler - Event Handling Loop.gvi"(message queue in=w328, error in=w327) -> (dup error in=w363)
    stop if w326
  }
  Unregister For Events(error in=w363, event registration refnum=s8) -> (error out=w364)
  Merge Errors(w364, w324) -> (error out=w365)
  Destroy User Event(error in=w365, user event=w257)
  disable {
    frame Enabled { }
    frame Disabled {
      call "Initialize.gvi"(device name="cam0") -> (session out=w366, error out=w367)
      call "Configure Grab.gvi"(session in=w366, error in=w367) -> (session out=w368, error out=w369)
      call "Create Image.gvi"(image name="image_1") -> (new image=w370)
      while {
        call "Grab.gvi"(session in=w368, error in=w369, image in=w370) -> (session out=w371, error out=w372)
        stop if $Stop
      }
      call "Close.gvi"(session=w371, error in=w372)
    }
  }
